# Grasshopper definition bencher_6.gh (Grasshopper 1.0.7)
# plug-ins: Heteroptera, Human, LunchBox, MetaHopper, Wombat, HDTTreeUtils, Telepathy, Impala

number_slider = Slider(2, range=2..1000)  # disabled
number_slider_2 = Slider(1000, range=0..1000)  # disabled
number_slider_3 = Slider(1000, range=1000..200000)  # disabled
dom = ConstructDomain(DomainStart=number_slider, DomainEnd=number_slider_2)  # disabled
number_slider_4 = Slider(120000, range=1..120000)  # disabled
random = Random(Range=dom, Number=1, Seed=number_slider_4)  # disabled
number_slider_5 = Slider(2500, range=40..2500)
number_slider_6 = Slider(40000, range=0..40000)  # disabled
random_2 = Random(Range=dom, Number=1, Seed=number_slider_3)  # disabled
number_slider_7 = Slider(5000, range=1000..5000)
number_slider_8 = Slider(5000, range=0..10000)
number_slider_9 = Slider(200, range=0..1000)
number_slider_10 = Slider(10000, range=40..10000)
number_slider_11 = Slider(50, range=0..100)  # disabled
number_slider_12 = Slider(5, range=0..10)  # disabled
dom_2 = ConstructDomain(DomainStart=number_slider, DomainEnd=random)  # disabled
dom_3 = ConstructDomain(DomainStart=number_slider, DomainEnd=random_2)  # disabled
random_3 = Random(Range=dom_2, Number=random, Seed=2)  # disabled
rnd = Random(Number=number_slider_4, bipolarity=True)  # disabled
rnd_2 = Random(Number=number_slider_4, bipolarity=True)  # disabled
random_4 = Random(Range=dom_3, Number=random_2, Seed=2)  # disabled
rnd_vector = RandomVector(Number=number_slider_7, Length=Slider(50, range=0..100), isflat=True)
partition = PartitionList(List=rnd, Size=random_4)  # disabled
partition_2 = PartitionList(List=rnd_2, Size=random_3)  # disabled
partition_3 = PartitionList(List=rnd_vector, Size=Slider(20, range=0..100))
dom_4 = ConstructDomain(DomainStart=Slider(3, range=3..50), DomainEnd=Slider(20, range=0..100))
random_5 = Random(Range=dom_4, Number=Slider(2, range=0..10), Seed=number_slider_7)
intcrv = Interpolate(Vertices=partition_3, Degree=3, Periodic=False, KnotStyle=1)  # -> flatten(Curve), Length, Domain
lng = ListLength(List=intcrv.Curve)
division = Division(A=lng, B=2)
num = Number(partition)  # disabled
num_2 = Number(partition_2)  # disabled
num_3 = Number(partition_2)  # disabled
num_4 = Number(partition)  # disabled
item = ListItem(List=random_5, Index=0, Wrap=True)  # -> Item, Item1
split = SplitList(List=intcrv.Curve, Index=division)  # -> ListA, ListB
random_6 = Random(Range=dom_4, Number=item.Item1, Seed=2)
random_7 = Random(Range=dom_4, Number=item.Item, Seed=Slider(4, range=0..10))
qdiv = QuickDivide(A=num_2, B=num)  # disabled
qmod = QuickMod(A=num_2, B=num)  # disabled
qadd = QuickAdd(A=num_2, B=num)  # disabled
qmult = QuickMultiply(A=num_2, B=num)  # disabled
qsub = QuickSubtract(A=num_2, B=num)  # disabled
partition_4 = PartitionList(List=split.ListB, Size=random_6)  # -> flatten(Chunks)
partition_5 = PartitionList(List=split.ListA, Size=random_7)  # -> flatten(Chunks)
crv = Curve(partition_4)
crv_2 = Curve(partition_5)
ccx = CurveCurve(CurveA=crv_2, CurveB=crv, UseTasks=True)  # -> Points, ParamsA, ParamsB
parccx = ParCurveCurveIntersect(CurveA=crv_2, CurveB=crv)  # -> Points, ParamsA, ParamsB, Intersection
tstat = TreeStatistics(Tree=parccx.Points)  # -> Paths, Length, Count
tstat_2 = TreeStatistics(Tree=qadd)  # -> Paths, Length, Count
stopwatch = BenchComponent(Input=ccx.Points)
stopwatch_2 = BenchComponent(Input=parccx.Points)
ma = MassAddition(Input=tstat_2.Length)  # -> Result, PartialResults
impalatime = RemoteSender(stopwatch_2)
nativetime = RemoteSender(stopwatch)
int = Integer(tstat.Count)

# ---- group: File Setup
panel = Panel("""_-Options _Appearance _Colors _Viewport _Background=255,255,255 _Enter _Enter _Enter
_Grid _ShowGrid=No _ShowGridAxes=No _ShowWorldAxes=No _ApplyTo=AllViewports _Enter""")
Y = UnitY(Factor=1)
pt = Point(Point(5, 5, 10))
pt_2 = Point(Point(5, 5, 0))
rhcom = RhinoCommand(SendCommandToggle=Toggle(True), CommandString=panel)
mod_viewport = ModifyViewport(ViewportName="Top", CameraLocation=pt, CameraTarget=pt_2, CameraUp=Y, AnimateRestore=False, RestoreFrames=10)

# ---- group: Bencher_Controls
bench_name = Panel("r6_mtx_flat_Bench")
swatch = ColourSwatch(SwatchColor=RGB(255, 0, 0))
swatch_2 = ColourSwatch(SwatchColor=RGB(0, 115, 255))
reset_pipeline = BooleanToggle(False)
view_default = BooleanToggle(True)
write_csv = BooleanToggle(False)
bakegraph = BooleanToggle(False)
saveview = BooleanToggle(False)
running_av = Slider(50, range=0..100)
text_tag_size = Slider(0.25, range=0..1)
graph_dims = Slider(10, range=0..10)
autoscale_avg = Slider(0, range=0..100)
problem_size_rc = Integer(flatten(int))

# ----
benchmark_size = RemoteSender(problem_size_rc)
benchmark_name = RemoteSender(bench_name)
benchmark_autosmooth = RemoteSender(autoscale_avg)
benchmark_smooth = RemoteSender(running_av)
benchmark_reset = RemoteSender(reset_pipeline)
color_baseline = RemoteSender(swatch_2)
color_impala = RemoteSender(swatch)
save_default = RemoteSender(view_default)
graph_text = RemoteSender(text_tag_size)
graph_dim = RemoteSender(graph_dims)
save_csv = RemoteSender(write_csv)
save_bake = RemoteSender(bakegraph)
save_view = RemoteSender(saveview)
Y_2 = UnitY(Factor=1)
nativetime_2 = RemoteReceiver(nativetime)
impalatime_2 = RemoteReceiver(impalatime)
neg = Negative(Value=Y_2)
series = Series(Start=0, Step=1, Count=Slider(0, range=0..10))
neg_2 = Negative(Value=series)
graph_dim_2 = RemoteReceiver(graph_dim)

# ---- group: Graph Setup
X = UnitX(Factor=1)
graph_dim_3 = RemoteReceiver(graph_dim)
pt_3 = Point(Point(0, 0, 0))
Y_3 = UnitY(Factor=1)
graph_dim_4 = RemoteReceiver(graph_dim)
pt_4 = Point(Point(0, 0, 0))
Y_4 = UnitY(Factor=1)
line = LineSDL(Start=pt_3, Direction=X, Length=graph_dim_3)
number_slider_13 = Slider(10, range=0..10)
number_slider_14 = Slider(1, range=0..1)
line_2 = LineSDL(Start=pt_4, Direction=Y_3, Length=graph_dim_4)
curvepoint = PointOnCurve(line, parameter=0.5)
neg_3 = Negative(Value=Y_4)
divide = DivideCurve(Curve=line, Count=10, Kinks=False)  # -> Points, Tangents, Parameters
divide_2 = DivideCurve(Curve=line_2, Count=10, Kinks=False)  # -> Points, Tangents, Parameters
number_slider_15 = Slider(0.4, range=0..1)
recgrid = Rectangular(
    Plane=PlaneXY(0, 0, 0),
    SizeX=number_slider_14,
    SizeY=number_slider_14,
    ExtentX=number_slider_13,
    ExtentY=number_slider_13)  # -> Cells, Points
swatch_3 = ColourSwatch(SwatchColor=RGB(0, 0, 0))
move = Move(Geometry=curvepoint, Motion=neg_3)  # -> Geometry, Transform
pt_5 = Point(Point(-0.5, 0, 0))
pt_6 = Point(Point(0, -0.5, 0))
move_2 = Move(Geometry=divide_2.Points, Motion=pt_5)  # -> Geometry, Transform
move_3 = Move(Geometry=divide.Points, Motion=pt_6)  # -> Geometry, Transform
benchmark_name_2 = RemoteReceiver(benchmark_name)
tag = TextTag3D(Location=move.Geometry, Text="Problem Size", Size=number_slider_15, Colour=swatch_3, Justification=2)
crv_3 = Curve(recgrid.Cells)
graph_text_2 = RemoteReceiver(graph_text)
swatch_4 = ColourSwatch(SwatchColor=RGB(0, 0, 0))
preview = CustomPreview(Geometry=crv_3, Shader=ColourSwatch(SwatchColor=RGB(209, 209, 209)))
concat = Concatenate(FragmentA=benchmark_name_2, FragmentC="::", FragmentB="Graph")
preview_2 = CustomPreview(Geometry=[line_2, line], Shader=ColourSwatch(SwatchColor=RGB(0, 0, 0)))
layerattr = LayerAttr(lay=concat)
save_bake_2 = RemoteReceiver(save_bake)
bake = BakeGeometry(
    Bake=save_bake_2,
    Geometry=[line, line_2, divide.Points, divide_2.Points],
    Attributes=layerattr,
    DeleteOldBakes=False,
    PreserveTrees=False)

# ----
move_4 = Move(Geometry=move.Geometry, Motion=neg)  # -> Geometry, Transform

# ---- group: File Setup
benchmark_name_3 = RemoteReceiver(benchmark_name)
color_impala_2 = RemoteReceiver(color_impala)
color_baseline_2 = RemoteReceiver(color_baseline)
concat_2 = Concatenate(FragmentA=benchmark_name_3, FragmentC="::", FragmentB="Baseline")
concat_3 = Concatenate(FragmentA=benchmark_name_3, FragmentC="::", FragmentB="Impala")
save_bake_3 = RemoteReceiver(save_bake)
merge = Merge(Data1=concat_3, Data2=concat_2, Data3=concat)
merge_2 = Merge(Data1=color_impala_2, Data2=color_baseline_2, Data3=ColourSwatch(SwatchColor=RGB(0, 0, 0)))
layers = CreateModifyLayers(LayerName=merge, LayerColor=merge_2, Visibility=save_bake_3, DeleteLayer=False, enableFullPath=True)  # -> LayerNames, LayerFullPath
item_2 = ListItem(List=layers.LayerFullPath, Index=0, Wrap=True)

# ----
benchmark_autosmooth_2 = RemoteReceiver(benchmark_autosmooth)

# ---- group: Cache BEnches
benchmark_reset_2 = RemoteReceiver(benchmark_reset)
benchmark_size_2 = RemoteReceiver(benchmark_size)
c_script = CSharpScript(x=benchmark_size_2, y=benchmark_reset_2)  # -> A; inputs y: Boolean
# ---------- c_script: C# ----------
    keepList.Add(x);
    if (y){
      keepList = new List<object>();
    }
    A = keepList;
# ---------- c_script: C# additional code ----------
  List<object> keepList = new List<object>();
# ---------- end c_script ----------

# ----
c_script_2 = CSharpScript(x=impalatime_2, y=benchmark_reset_2)  # -> A; inputs y: Boolean; same code as c_script
c_script_3 = CSharpScript(x=nativetime_2, y=benchmark_reset_2)  # -> A; inputs y: Boolean; same code as c_script

# ---- group: Cache BEnches (continued)
short = ShortestList(ListA=c_script, ListB=c_script_2, ListC=c_script_3, TrimMode=2)  # -> ListA, ListB, ListC
sort = SortList(Keys=short.ListA, ValuesA=short.ListB, ValuesB=short.ListC)  # -> Keys, ValuesA, ValuesB

# ----
cull_i = CullIndex(List=sort.ValuesB, Indices=neg_2, Wrap=True)
cull_i_2 = CullIndex(List=sort.ValuesA, Indices=neg_2, Wrap=True)
cull_i_3 = CullIndex(List=sort.Keys, Indices=neg_2, Wrap=True)

# ---- group: Cache BEnches (continued)
sort_impala = RemoteSender(cull_i_2)
sort_ps = RemoteSender(cull_i_3)
sort_base = RemoteSender(cull_i)

# ----
sort_impala_2 = RemoteReceiver(sort_impala)
sort_base_2 = RemoteReceiver(sort_base)
merge_3 = Merge(Data1=sort_impala_2, Data2=sort_base_2)
sort_2 = SortList(Keys=merge_3)  # -> Keys, ValuesA
rev = ReverseList(List=sort_2.Keys)
subset = SubList(List=rev, Domain=benchmark_autosmooth_2, Wrap=True)  # -> List, Index
avr = Average(Input=subset.List)
item_3 = ListItem(List=avr, Index=0, Wrap=True)
benchmark_maxtime = RemoteSender(item_3)

# ---- group: Problem Size
sort_ps_2 = RemoteReceiver(sort_ps)
rev_2 = ReverseList(List=sort_ps_2)
graph_dim_5 = RemoteReceiver(graph_dim)
item_4 = ListItem(List=rev_2, Index=0, Wrap=True)
item_5 = ListItem(List=sort_ps_2, Index=0, Wrap=True)
dom_5 = ConstructDomain(DomainStart=item_5, DomainEnd=item_4)
benchmark_maxps = RemoteSender(item_4)
remap = RemapNumbers(Value=sort_ps_2, Source=dom_5, Target=graph_dim_5)  # -> Mapped, Clipped
bench_xvalue = RemoteSender(remap.Mapped)

# ---- group: Graph Setup (continued)
benchmark_maxtime_2 = RemoteReceiver(benchmark_maxtime)
benchmark_maxps_2 = RemoteReceiver(benchmark_maxps)
multiplication = Multiplication(A=divide_2.Parameters, B=benchmark_maxtime_2)
multiplication_2 = Multiplication(A=benchmark_maxps_2, B=divide.Parameters)
formats = PythonScript(x=multiplication)  # -> a
# ---------- formats: Python ----------
num = int(x)

sec = 1000
min = sec * 60
hr = min * 60

if num > hr * 10:
    n = str(int(num/hr)) + "H"
elif num > min * 10:
    n = str(int(num/min)) + "M" 
elif num > sec * 10:
    n = str(int(num/sec)) + "S"
else:
    n = str(num)

a = n
# ---------- end formats ----------
formatk = PythonScript(x=multiplication_2)  # -> a
# ---------- formatk: Python ----------
num = int(x)

if num > 10000000000:
    n = str(int(num/1000000000)) + "B"
elif num > 10000000:
    n = str(int(num/1000000)) + "M" 
elif num > 10000:
    n = str(int(num/1000)) + "K"
else:
    n = str(num)

a = n
# ---------- end formatk ----------
concat_4 = Concatenate(FragmentA=formats, FragmentB=" ms")
tag_2 = TextTag3D(Location=move_2.Geometry, Text=concat_4, Size=graph_text_2, Colour=swatch_4, Justification=9)
tag_3 = TextTag3D(Location=move_3.Geometry, Text=formatk, Size=graph_text_2, Colour=swatch_4, Justification=5)

# ----
division_2 = Division(A=sort_base, B=sort_impala)
benchmark_maxtime_3 = RemoteReceiver(benchmark_maxtime)
avr_2 = Average(Input=division_2)
speedup = RemoteSender(avr_2)
speedup_2 = RemoteReceiver(speedup)
speedup_3 = Panel(speedup_2)
speedup_4 = RemoteReceiver(speedup)
format = Format(Format="{0:0.00}x", Culture=127, Data0=speedup_4)
concat_5 = Concatenate(FragmentA="Average Speedup: ", FragmentB=format)
tag_4 = TextTag3D(Location=move_4.Geometry, Text=concat_5, Size=number_slider_15, Colour=swatch_3, Justification=2)
division_3 = Division(A=graph_dim_2, B=benchmark_maxtime_3)

sort_impala_3 = RemoteReceiver(sort_impala)
multiplication_3 = Multiplication(A=sort_impala_3, B=division_3)
sort_ps_3 = RemoteReceiver(sort_ps)
graftbydata = GraftByData(InputData=multiplication_3, PathsToAssign=sort_ps_3)
benchmark_smooth_2 = RemoteReceiver(benchmark_smooth)
avr_3 = Average(Input=graftbydata)  # -> flatten(ArithmeticMean)
bench_xvalue_2 = RemoteReceiver(bench_xvalue)
python = PythonScript(x=avr_3, y=benchmark_smooth_2)  # -> a; inputs x: list
# ---------- python: Python ----------
result = []
rng = int(y)

for i in range(len(x)):
    sum = 0
    num = 0
    for j in range(-rng,rng+1):
        if (i+j) >= 0 and (i+j) < len(x):
            sum += x[i + j]
            num += 1.0
    result.append(sum/num)
    
a = result
# ---------- end python ----------
pt_7 = ConstructPoint(XCoordinate=bench_xvalue_2, YCoordinate=python, ZCoordinate=0)
pline = PolyLine(Vertices=pt_7, Closed=False)
color_impala_3 = RemoteReceiver(color_impala)
item_6 = ListItem(List=reverse(pt_7), Index=0, Wrap=True)
merge_4 = Merge(Data1=pt_7, Data2=pline)
save_bake_4 = RemoteReceiver(save_bake)
layerattr_2 = LayerAttr(lay=item_2)
preview_3 = CustomPreview(Geometry=pline, Shader=color_impala_3)
tag_5 = TextTag3D(Location=item_6, Text="  Impala", Size=Slider(0.25, range=0..1), Colour=color_impala_3, Justification=7)
preview_4 = CustomPreview(Geometry=pt_7, Shader=color_impala_3)
bake_2 = BakeGeometry(Bake=save_bake_4, Geometry=merge_4, Attributes=layerattr_2, DeleteOldBakes=False, PreserveTrees=False)

# ---- group: Baseline
sort_base_3 = RemoteReceiver(sort_base)
sort_ps_4 = RemoteReceiver(sort_ps)
multiplication_4 = Multiplication(A=sort_base_3, B=division_3)
graftbydata_2 = GraftByData(InputData=multiplication_4, PathsToAssign=sort_ps_4)
benchmark_smooth_3 = RemoteReceiver(benchmark_smooth)
avr_4 = Average(Input=graftbydata_2)  # -> flatten(ArithmeticMean)
bench_xvalue_3 = RemoteReceiver(bench_xvalue)
ravg = RunningAverage(L=avr_4, I=benchmark_smooth_3)  # -> R; inputs L: list
# ---------- ravg: Python ----------
result = []
rng = int(I)

for i in range(len(L)):
    sum = 0
    num = 0
    for j in range(-rng,rng+1):
        if (i+j) >= 0 and (i+j) < len(L):
            sum += L[i + j]
            num += 1.0
    result.append(sum/num)
    
R = result
# ---------- end ravg ----------
pt_8 = ConstructPoint(XCoordinate=bench_xvalue_3, YCoordinate=ravg, ZCoordinate=0)
save_default_2 = RemoteReceiver(save_default)
pline_2 = PolyLine(Vertices=pt_8, Closed=False)
filter = StreamFilter(Gate=save_default_2, Stream1=pline_2)
merge_5 = Merge(Data1=pt_8, Data2=pline_2)
color_baseline_3 = RemoteReceiver(color_baseline)
save_bake_5 = RemoteReceiver(save_bake)
filter_2 = StreamFilter(Gate=save_default_2, Stream1=pt_8)
layerattr_3 = LayerAttr(lay=concat_2)
item_7 = ListItem(List=reverse(pt_8), Index=0, Wrap=True)
bake_3 = BakeGeometry(Bake=save_bake_5, Geometry=merge_5, Attributes=layerattr_3, DeleteOldBakes=False, PreserveTrees=False)
tag_6 = TextTag3D(Location=item_7, Text="  Baseline", Size=Slider(0.25, range=0..1), Colour=color_baseline_3, Justification=7)
preview_5 = CustomPreview(Geometry=filter, Shader=color_baseline_3)
preview_6 = CustomPreview(Geometry=filter_2, Shader=color_baseline_3)

# ----
division_4 = Division(A=avr_3, B=avr_4)
avr_5 = Average(Input=division_4)
subtraction = Subtraction(A=Slider(1, range=0..1), B=avr_5)
multiplication_5 = Multiplication(A=subtraction, B=Slider(100, range=0..100))
int_2 = Integer(multiplication_5)

# ---- group: Save
benchmark_maxtime_4 = RemoteReceiver(benchmark_maxtime)
benchmark_maxps_3 = RemoteReceiver(benchmark_maxps)
bench_xvalue_4 = RemoteReceiver(bench_xvalue)
multiplication_6 = Multiplication(A=ravg, B=benchmark_maxtime_4)
multiplication_7 = Multiplication(A=bench_xvalue_4, B=benchmark_maxps_3)
multiplication_8 = Multiplication(A=python, B=benchmark_maxtime_4)
int_3 = Integer(multiplication_8)
int_4 = Integer(multiplication_6)
int_5 = Integer(multiplication_7)
benchmark_name_4 = RemoteReceiver(benchmark_name)
entwine = Entwine(Branch00=int_5, Branch01=int_4, Branch02=int_3, FlattenInputs=True)
panel_2 = Panel("""Problem Size
Default (ms)
Impala (ms)""")
concat_6 = Concatenate(FragmentA="bench/", FragmentB=benchmark_name_4, FragmentC=".jpg")
concat_7 = Concatenate(FragmentA="bench/", FragmentB=benchmark_name_4, FragmentC=".csv")
csv = CreateCSV(DataGridHeaders=panel_2, ValueTree=entwine, Delimiter=",")
save_csv_2 = RemoteReceiver(save_csv)
relpath = RelativePath(Path=concat_7)
relpath_2 = RelativePath(Path=concat_6)
save_view_2 = RemoteReceiver(save_view)
writetxt = WriteToTextFile(Run=save_csv_2, TextToWrite=csv, FilePath=relpath, Append=False, NewOnly=False)
saveview_2 = SaveViewportToFile(Run=save_view_2, ViewportName="Top", Render=False, FilePath=relpath_2, ScaleFactor=Slider(1.5, range=0..10))
panel_3 = Panel(writetxt)
panel_4 = Panel(saveview_2)

# ==== cluster LayerAttr
lay = ClusterInput()
createatts = CreateAttributes(LayerName=lay, enableFullPath=True)
att = ClusterOutput(createatts)
