# Grasshopper definition generictest.gh (Grasshopper 0.9.76)
# plug-ins: MetaHopper, Impala

number_slider = Slider(1000000, range=0..1000000)
pow = Power(A=Slider(10, range=0..10), B=Slider(6.5, range=0..10))
number_slider_2 = Slider(26, range=0..100)
number_slider_3 = Slider(5000, range=0..10000)
number_slider_4 = Slider(40, range=0..10000)
number_slider_5 = Slider(235, range=0..1000)
addition = Addition(A=Slider(50000, range=0..100000), B=Slider(0.5, range=0..0.5))
division = Division(A=addition, B=10)
button = Button()
random = Random(Range=Domain(0, 1), Number=addition, Seed=2)
random_2 = Random(Range=division, Number=number_slider_2, Seed=2)
random_3 = Random(Range=division, Number=number_slider_2, Seed=number_slider_5)
random_4 = Random(Range=Domain(0, 1), Number=addition, Seed=number_slider_5)
objbynn = GetObjectByNickname(NickName="TestDivPar1")
objbynn_2 = GetObjectByNickname(NickName="TestDivManual")
objbynn_3 = GetObjectByNickname(NickName="TestDivPar2")
int = Integer(random_3)
int_2 = Integer(random_2)
partition = PartitionList(List=random, Size=int_2)
partition_2 = PartitionList(List=random_4, Size=int)
partition_3 = PartitionList(List=partition, Size=[3, 2])
num = Number(partition_3)
num_2 = Number(partition_2)
subtraction = Subtraction(A=num_2, B=num)
quicksubtract = QuickSubtract(A=num_2, B=num)
testdivmanual = ManualDiv(A=num_2, B=num)
baseline = Division(A=num_2, B=num)  # disabled
testdivpar2 = ParallelDiv(A=num_2, B=num)  # disabled
testdivpar1 = ParallelDiv(A=num_2, B=num)  # disabled
tstat = TreeStatistics(Tree=testdivpar2)  # -> Paths, Length, Count; disabled
c_script = CSharpScript(x=objbynn_3, y=button, z=tstat.Count)  # -> out, A; inputs y: Boolean
# ---------- c_script: C# ----------
    if (!y){
      iterations++;
      ms += (x as GH_Component).ProcessorTime.TotalMilliseconds;
      A = ms / (double) iterations;
    }
    else{
      iterations = 0;
      ms = 0;
    }
# ---------- c_script: C# additional code ----------
  private int iterations = 0;
  private double ms = 0;
# ---------- end c_script ----------
panel = Panel(c_script.A)
tstat_2 = TreeStatistics(Tree=testdivpar1)  # -> Paths, Length, Count; disabled
c_script_2 = CSharpScript(x=objbynn, y=button, z=tstat_2.Count)  # -> out, A; inputs y: Boolean; same code as c_script
panel_2 = Panel(c_script_2.A)
equals = Equality(FirstNumber=quicksubtract, SecondNumber=subtraction)  # -> Equality, Inequality; disabled
comptree = CompTree(T_2=subtraction, T=testdivmanual)  # disabled
comptree_2 = CompTree(T_2=subtraction, T=quicksubtract)  # disabled
tstat_3 = TreeStatistics(Tree=testdivmanual)  # -> Paths, Length, Count
c_script_3 = CSharpScript(x=objbynn_2, y=button, z=tstat_3.Count)  # -> out, A; inputs y: Boolean; same code as c_script
panel_3 = Panel(c_script_3.A)
cset = CreateSet(List=flatten(equals.Equality))  # -> flatten(Set), Map; disabled
panel_4 = Panel(comptree_2)
series = Series(Start=0, Step=1, Count=tstat_3.Length)
panel_5 = Panel(cset.Set)

# ==== cluster CompTree
T = ClusterInput()
T_2 = ClusterInput()
tstat = TreeStatistics(Tree=T)  # -> Paths, Length, Count
tstat_2 = TreeStatistics(Tree=T_2)  # -> Paths, Length, Count
dpath = DeconstructPath(Branch=tstat_2.Paths)
dpath_2 = DeconstructPath(Branch=tstat.Paths)
equals = Equality(FirstNumber=tstat_2.Length, SecondNumber=tstat.Length)  # -> Equality, Inequality
equals_2 = Equality(FirstNumber=tstat_2.Count, SecondNumber=tstat.Count)  # -> Equality, Inequality
equals_3 = Equality(FirstNumber=dpath, SecondNumber=dpath_2)  # -> flatten(Equality), Inequality
cset = CreateSet(List=equals_2.Equality)  # -> Set, Map
cset_2 = CreateSet(List=equals.Equality)  # -> Set, Map
cset_3 = CreateSet(List=equals_3.Equality)  # -> Set, Map
not = GateNot(A=cset.Set)
not_2 = GateNot(A=cset_2.Set)
not_3 = GateNot(A=cset_3.Set)
int = Integer(not)
int_2 = Integer(not_2)
int_3 = Integer(not_3)
ma = MassAddition(Input=flatten([int_3, int_2, int]))  # -> Result, PartialResults
equals_4 = Equality(FirstNumber=ma.Result, SecondNumber="0")  # -> Equality, Inequality
bool = Boolean(equals_4.Equality)
bool_2 = ClusterOutput(bool)
