# Grasshopper definition impala_demo.gh (Grasshopper 0.9.76)
# plug-ins: Heteroptera, Impala

# Containment Operations (Point in X)
# Containment Test: Generates a field of points and planar curves.
curves = Slider(100, range=0..100)
# Physical Operations (Closest Points)
of_curve_points = Slider(80, range=0..10000)
scale_factor = Slider(30, range=0..100)
points_per_curve = Slider(20, range=0..100)
of_points = Slider(20, range=0..100000)
number_slider = Slider(200000, range=0..1000000)
# QuickMath Components
# Unary Arithmetic Operators: Double Average (qAvg)
# Double Bounds (qBounds)
# Double Absolute Value (qAbs)
# Double Negation (qNeg)
number_slider_2 = Slider(200000, range=0..1000000)
# Binary Arithmetic Operators: Double Addition (qAdd)
# Double Subtraction (qSub)
# Double Multiplication (qMult)
# Double Division (qDiv)
number_slider_3 = Slider(2000, range=0..10000)
rnd_vector = RandomVector(Number=curves, Length=Domain(1, 5))
points = Slider(20, range=0..10000)
rnd = Random(Number=number_slider_2, bipolarity=True)
rnd_2 = Random(Number=number_slider, bipolarity=True)
rnd_3 = Random(Number=number_slider, bipolarity=True)
rectangle = Rectangle(Plane=rnd_vector, XSize=Domain(-1, 1), YSize=Domain(-2, 2), Radius=0)  # -> Rectangle, Length
rnd_vector_2 = RandomVector(Number=of_curve_points, Length=scale_factor)
partition = PartitionList(List=rnd_vector_2, Size=points_per_curve)
drec = DeconstuctRectangle(Rectangle=rectangle.Rectangle)  # -> BasePlane, XInterval, YInterval
crv = Curve(rectangle.Rectangle)
rnd_vector_3 = RandomVector(Number=points, Length=Domain(1, 5))

qneg = QuickNeg(A=rnd)
qavg = QuickAvg(A=rnd)
qbounds = QuickBounds(A=rnd)
qabs = QuickAbs(A=rnd)
# Binary Comparison Operators: Double Almost Equals (qAEQ)
# Double Equals (qEq)
# Double Less Than (qLT)
# Double Greater Than (qGT)
avr = Average(Input=rnd)
bnd = Bounds(Numbers=rnd)
abs = Absolute(Value=rnd)
neg = Negative(Value=rnd)

rnd_vector_4 = RandomVector(Number=of_points, Length=scale_factor)
intcrv = Interpolate(Vertices=partition, Degree=3, Periodic=False, KnotStyle=1)  # -> Curve, Length, Domain
rnd_vector_5 = RandomVector(Number=of_points, Length=scale_factor)

qadd = QuickAdd(A=rnd_2, B=rnd_3)  # disabled
qsub = QuickSubtract(A=rnd_2, B=rnd_3)  # disabled
qmult = QuickMultiply(A=rnd_2, B=rnd_3)  # disabled
qdiv = QuickDivide(A=rnd_2, B=rnd_3)  # disabled
qmod = QuickMod(A=rnd_2, B=rnd_3)  # disabled

box = DomainBox(Base=drec.BasePlane, X=drec.XInterval, Y=drec.YInterval, Z="2.0")
rnd_vector_6 = RandomVector(Number=of_curve_points, Length=scale_factor)
flatten = FlattenTree(Tree=intcrv.Curve, Path="{0}")  # -> flatten(Tree)
partition_2 = PartitionList(List=rnd_vector_6, Size=points_per_curve)
mesh = MeshBrep(
    Brep=box,
    Settings={GridMaxCount=0, GridMinCount=16, JaggedSeams=False, MaxEdgeLength=0, MinEdgeLength=0.0001, MinTolerance=0, Refine=True, RefineAngle=0, RelativeTolerance=0.65, SimplePlanes=True, Tolerance=0})
pt = Point(rnd_vector_3)
shift = ShiftList(List=flatten, Shift=1, Wrap=True)  # -> flatten(List)
number_slider_4 = Slider(200000, range=0..1000000)
pt_2 = Point(graft(pt))
intcrv_2 = Interpolate(Vertices=partition_2, Degree=3, Periodic=False, KnotStyle=1)  # -> Curve, Length, Domain
mesh_2 = Mesh(graft(mesh))
crv_2 = Curve(crv)
merge = Merge(Data1=simplify(graft(flatten)), Data2=simplify(graft(shift)))
number_slider_5 = Slider(200000, range=0..1000000)
pt_3 = Point(rnd_vector_5)
pt_4 = Point(rnd_vector_5)
loft = Loft(Curves=merge, Options={Adjust=False, Closed=False, LoftEnds=0, LoftSimp=0, LoftType=0, Rebuild=10, Refit=0.01})
# Vector Operators: Vector Addition (vAdd)
# Vector Subtraction (vSub)
# Vector Average (vAvg)
# Vector Bounds (vBounds)
rnd_vector_7 = RandomVector(Number=number_slider_4, Length=Domain(1, 5))
rnd_vector_8 = RandomVector(Number=number_slider_4, Length=Domain(1, 5))

parmmeshinc = ParMMeshInc(Mesh=mesh_2, Points=pt_2, Strict=False)  # -> Included, Index; disabled
# Containment Operators: Brep Inclusion (ParBrepInc)
# Multiple Brep Inclusion (ParMBrepInc)
# Mesh Inclusion (ParMeshInc)
# Multuple Mesh Inclusion (ParMMeshInc)
# Curve Inclusion (ParPtInCrv)
# Multuple Curve Inclusion (ParPtInCurves)
parmeshinc = ParMeshInc(Mesh=mesh_2, Points=pt_2, Strict=False)  # disabled
parptincrvs = ParPointInCurves(Points=pt_2, Curve=crv_2, Plane=PlaneXY(0, 0, 0), Strict=False)  # -> Included, Index; disabled
parptincrv = ParPointInCurve(Points=pt_2, Curve=crv_2, Plane=PlaneXY(0, 0, 0), Strict=False)  # disabled

rnd_4 = Random(Number=number_slider_5, bipolarity=True)
rnd_5 = Random(Number=number_slider_5, bipolarity=True)
mesh_3 = MeshBrep(
    Brep=loft,
    Settings={GridMaxCount=0, GridMinCount=16, JaggedSeams=False, MaxEdgeLength=0, MinEdgeLength=0.0001, MinTolerance=0, Refine=True, RefineAngle=0, RelativeTolerance=0.65, SimplePlanes=True, Tolerance=0})
range = Range(Domain=Domain(0, 1), Steps=Slider(3000, range=0..10000))

# ----
# Physical Operators: Point Closest Point (ParPointCP)
# Curve Closest Point (ParCurveCP)
# Multiple Curve Closest Point (ParCCCP)
# Brep Closest Point (ParBrepCP)
# Mesh Closest Point (ParMeshCP)
# Divide Curve Length (ParDivLen)
# Shatter (ParShatter)
parcccp = ParClosestCurveCP(Point=pt_4, Curves=flatten(intcrv.Curve), Threshold=1.797693135e+308)  # -> Points, Parameters, Index, Distance; disabled
parpointcp = ParPointCP(Points=pt_4, Cloud=rnd_vector_4, Number=1)  # -> Points, Indices; disabled
parshatter = ParShatter(Curve=reparameterize(intcrv_2.Curve), Paramters=range)  # disabled
parcurvecp = CurveClosestPoint(Point=pt_4, Curve=intcrv.Curve, Tolerance=1.797693135e+308)  # -> Point, Parameter, Projected; disabled
parmeshcp = ParMeshCP(Points=pt_3, Mesh=mesh_3, Threshold=1.797693135e+308)  # -> Points, FaceIndex, Projected; disabled
pardivlen = ParDivideLength(Curve=intcrv_2.Curve, Length=Slider(0.05, range=0..0.1))  # -> Points, Tangents, Parameters; disabled

vadd = VecAdd(A=rnd_vector_7, B=rnd_vector_8)
vsub = VecSubtract(A=rnd_vector_7, B=rnd_vector_8)
vavg = VectorAvg(A=rnd_vector_8)
vbounds = VectorBounds(A=rnd_vector_8)

qaeq = QuickAEQ(A=rnd_4, B=rnd_5)  # disabled
qeq = QuickEq(A=rnd_4, B=rnd_5)  # disabled
qlt = QuickLT(A=rnd_4, B=rnd_5)  # disabled
qgt = QuickGT(A=rnd_5, B=rnd_5)  # disabled

stopwatch = BenchComponent(Input=[vadd, vsub, vavg, vbounds])
# BenchComponent (StopWatch): StopWatch benches all of its input components together simultaneously once they finish computing. It does nothing with the actual data it is fed.
# Benchmarking 101
# Bench Group (GStopWatch): GStopWatch benches all of the components in the group. It takes a sample anytime it is forced to recompute by an input stream. This is useful when there are many, many components in a group that all end up in one stream.
impala_time_ms = Panel(stopwatch)
number_slider_6 = Slider(50, range=0..100)
rnd_vector_9 = RandomVector(Number=Slider(200, range=0..1000), Length=number_slider_6)
rnd_vector_10 = RandomVector(Number=12, Length=number_slider_6)
# Intersection Operations
number_slider_7 = Slider(20, range=0..100)
partition_3 = PartitionList(List=rnd_vector_9, Size=Slider(10, range=0..10))
# IsoVist Operations
number_slider_8 = Slider(10, range=0..10)
sph = Sphere(Base=rnd_vector_10, Radius=Slider(20, range=0..100))
number_slider_9 = Slider(10, range=0..10)
number_slider_10 = Slider(47, range=0..100)
shift_2 = ShiftList(List=partition_3, Shift=1, Wrap=True)
number_slider_11 = Slider(50, range=0..100)
popgeo = PopulateGeometry(Geometry=sph, Count=number_slider_7, Seed=1)
vec2pt = Vector2Pt(PointA=partition_3, PointB=shift_2, Unitize=False)  # -> Vector, Length
facet = FacetDome(Points=popgeo)  # -> Pattern, Dome
rnd_6 = Random(Number=number_slider_8, bipolarity=False)
rnd_7 = Random(Number=number_slider_8, bipolarity=False)
rnd_8 = Random(Number=number_slider_8, bipolarity=False)
neg_2 = Negative(Value=number_slider_11)
boundary = BoundarySurfaces(Edges=facet.Pattern)
rnd_vector_11 = RandomVector(Number=Slider(1, range=0..1), Length=number_slider_10, isflat=True)
multiplication = Multiplication(A=rnd_6, B=number_slider_9)
multiplication_2 = Multiplication(A=rnd_7, B=number_slider_9)
# Isovist operators: Generates a random scene and casts a 2D and 3D isovist around it.
multiplication_3 = Multiplication(A=rnd_8, B=number_slider_9)
Y = UnitY(Factor=1)
jitter = Jitter(List=partition_3, Jitter=1, Seed=2)  # -> Values, Indices
pt_5 = ConstructPoint(XCoordinate=0, YCoordinate=0, ZCoordinate=0)
rnd_vector_12 = RandomVector(Number=12, Length=number_slider_10, isflat=True)
Z = UnitZ(Factor=Slider(2, range=0..10))
dom = ConstructDomain(DomainStart=neg_2, DomainEnd=number_slider_11)
join = BrepJoin(Breps=boundary)  # -> flatten(Breps), Closed
intcrv_3 = Interpolate(Vertices=jitter.Values, Degree=3, Periodic=False, KnotStyle=1)  # -> Curve, Length, Domain
intcrv_4 = Interpolate(Vertices=partition_3, Degree=3, Periodic=False, KnotStyle=1)  # -> Curve, Length, Domain
move = Move(Geometry=rnd_vector_11, Motion=Z)  # -> Geometry, Transform
line = LineSDL(Start=pt_5, Direction=Y, Length=1)
box_2 = CenterBox(Base=rnd_vector_12, X=multiplication_3, Y=multiplication_2, Z=multiplication)
mesh_4 = MeshBrep(
    Brep=join.Breps,
    Settings={GridMaxCount=0, GridMinCount=16, JaggedSeams=False, MaxEdgeLength=0, MinEdgeLength=0.0001, MinTolerance=0, Refine=True, RefineAngle=0, RelativeTolerance=0.65, SimplePlanes=True, Tolerance=0})
rectangle_2 = Rectangle(Plane=PlaneXY(0, 0, 0), XSize=dom, YSize=dom, Radius=0)  # -> Rectangle, Length
xy = XYPlane(Origin=move.Geometry)
project = Project(Geometry=intcrv_3.Curve, Plane=PlaneXY(0, 0, 0))  # -> Geometry, Transform
project_2 = Project(Geometry=intcrv_4.Curve, Plane=PlaneXY(0, 0, 0))  # -> Geometry, Transform
smesh = SimpleMesh(Brep=box_2)
mplane = MeshPlane(Boundary=rectangle_2.Rectangle, WidthCount=10, HeightCount=10)  # -> Mesh, Area
rotax = RotateAxis(Geometry=xy, Angle=Slider(0, range=0..1), Axis=line)  # -> Geometry, Transform
pt_6 = Point(move.Geometry)
vec = Vector(vec2pt.Vector)
crv_3 = Curve(intcrv_4.Curve)
crv_4 = Curve(project_2.Geometry)
mesh_5 = Mesh(mesh_4)
pt_7 = Point(partition_3)
brep = Brep(join.Breps)
crv_5 = Curve(project.Geometry)

pariso3d = ParIsoVist3D(Point=pt_6, Density=Slider(50, range=0..100), Radius=Slider(60, range=0..1000), Obstacles=flatten([smesh, mplane.Mesh]))  # -> Point, Index, Hit
pariso2d = ParIsoVist2d(
    Point=rnd_vector_11,
    Number=10,
    Radius=Slider(23, range=0..100),
    Obstacles=smesh,
    Plane=rotax.Geometry,
    Interval=Domain(0, 6.283185307))  # -> Point, Index, Hit

vdis = VectorDisplay(Anchor=pt_7, Vector=vec)
pline = PolyLine(Vertices=pariso2d.Point, Closed=invert(False))

parmeshray = ParMeshRayIntersect(Mesh=mesh_5, Point=pt_7, Direction=vec)  # -> Point, Index, Hit; disabled
# Intersection Operators: Mesh | Ray (ParMeshRay)
# Mesh | Curve (ParMCX)
# Brep | Line (ParBLX)
# Curve | Curve (ParCCX)
parmcx = ParMeshCurveIntersect(Mesh=mesh_5, Curve=crv_3)  # -> Points, Faces, Intersection; disabled
parccx = ParCurveCurveIntersect(CurveA=crv_5, CurveB=crv_4)  # -> Points, ParamsA, ParamsB, Intersection; disabled

demesh = DeconstructMesh(Mesh=pariso3d.Point)  # -> Vertices, Faces, Colours, Normals
deface = DeconstructFace(Face=demesh.Faces)  # -> CornerA, CornerB, CornerC, CornerD
# Analyses Iso3D's mesh output to determine which faces are affected or unaffacted by the raycast.
item = ListItem(List=pariso3d.Hit, Index=deface.CornerA, Wrap=True)
item_2 = ListItem(List=pariso3d.Hit, Index=deface.CornerB, Wrap=True)
item_3 = ListItem(List=pariso3d.Hit, Index=deface.CornerC, Wrap=True)
item_4 = ListItem(List=pariso3d.Hit, Index=deface.CornerD, Wrap=True)
and = GateAnd(A=item, B=item_2, C=item_3, D=item_4)
or = GateOr(A=item, B=item_2, C=item_3, D=item_4)
dom_2 = ConstructDomain(DomainStart=Slider(5, range=0..100), DomainEnd=Slider(30, range=0..100))
not = GateNot(A=or)
cull = CullPattern(List=demesh.Faces, CullPattern=not)
cull_2 = CullPattern(List=demesh.Faces, CullPattern=and)
rnd_vector_13 = RandomVector(Number=Slider(200, range=0..1000), Length=dom_2, isflat=True)
range_2 = Range(Domain=Slider(50, range=0..100), Steps=10)
lng = ListLength(List=range_2)
sqr = Square(Value=lng)
hit_mesh = ConstructMesh(Vertices=demesh.Vertices, Faces=cull_2)
free_mesh = ConstructMesh(Vertices=demesh.Vertices, Faces=cull)
# Extension Operations
partition_4 = PartitionList(List=rnd_vector_13, Size=Slider(16, range=0..100))
random = Random(Range=Slider(20, range=0..100), Number=sqr, Seed=2)
pt_8 = ConstructPoint(XCoordinate=range_2, YCoordinate=graft(range_2), ZCoordinate=0)  # -> flatten(Point)
Z_2 = UnitZ(Factor=random)
avr_2 = Average(Input=partition_4)
number_slider_12 = Slider(20, range=0..100)
cir = Circle(Plane=avr_2, Radius=1)
move_2 = Move(Geometry=pt_8, Motion=Z_2)  # -> Geometry, Transform
alongcrv = SortAlongCurve(Points=partition_4, Curve=cir)  # -> Points, Indices
srfgrid = SurfaceFromPoints(Points=move_2.Geometry, UCount=lng, Interpolate=False)  # -> reparameterize(Surface)
pline_2 = PolyLine(Vertices=alongcrv.Points, Closed=invert(False))
mesh_uv = MeshSurface(Surface=srfgrid, UCount=number_slider_12, VCount=number_slider_12, Overhang=True, Equalize=False)
box_3 = CenterBox(Base=PlaneXY(0, 0, 0), X=Slider(30, range=0..100), Y=Slider(20, range=0..100), Z=1)
flatten_2 = FlattenTree(Tree=pline_2, Path="{0}")
number_slider_13 = Slider(1, range=0..10)
demesh_2 = DeconstructMesh(Mesh=mesh_uv)  # -> Vertices, Faces, Colours, Normals

parviscen = ParVisualCenter(Curve=pline_2)  # -> flatten(Point); disabled
# ParMeshFlow: Flows points down a mesh according to the mesh gradient and a gravity vector. Good for fast flow analysis.
parmeshflow = ParMeshFlow(StartPoints=demesh_2.Vertices, Mesh=mesh_uv, Tolerance=0.1, MaximumSteps=100, Direction=Vector(0, 0, -1))  # -> Curves, Lengths, Steps; disabled
# PopHalton: Populates a 3d box with a number of pseudo-random low-covariance points according to a seeded Halton sequence. This is a fast, somewhat less flexible alternative to something like Pop3d.
pophalton = HaltonSequence(Box=box_3, Number=100)  # disabled

item_5 = ListItem(List=flatten_2, Index=number_slider_13, Wrap=True)
# ParVisCen: Finds the visual center of closed curves. This is useful when you have especially lopsided curves and want a point centered in the area with the most 'weight'.
item_6 = ListItem(List=parviscen, Index=number_slider_13, Wrap=True)

avr_3 = Average(Input=rnd_vector_8)  # disabled
addition = Addition(A=rnd_vector_7, B=rnd_vector_8)  # disabled
subtraction = Subtraction(A=rnd_vector_7, B=rnd_vector_8)  # disabled
bnd_2 = Bounds2D(Coordinates=rnd_vector_8)  # disabled

lng_2 = ListLength(List=[addition, subtraction, avr_3, bnd_2])

gstopwatch = BenchGroup(Reset=lng_2)

native_time_ms = Panel(gstopwatch)
