# Grasshopper definition mathdemo.gh (Grasshopper 0.9.76)
# plug-ins: Heteroptera, MetaHopper, Impala

random = Random(Range=Slider(235, range=0..1000), Number=Slider(2, range=0..10), Seed=2)
random_2 = Random(Range=Slider(6000, range=0..10000), Number=Slider(2, range=0..10), Seed=Slider(324, range=0..1000))
random_3 = Random(Range=Slider(400, range=0..10000), Number=Slider(2, range=0..10), Seed=Slider(324, range=0..1000))
item = ListItem(List=random_2, Index=0, Wrap=True)  # -> Item, Item1
item_2 = ListItem(List=random, Index=0, Wrap=True)  # -> Item, Item1
item_3 = ListItem(List=random_3, Index=0, Wrap=True)  # -> Item, Item1
int = Integer(item_2.Item)
int_2 = Integer(item_2.Item1)
number_slider = Slider(10000, range=0..1000000)
random_4 = Random(Range=Slider(1, range=0..1), Number=item.Item1, Seed=int_2)
random_5 = Random(Range=item_3.Item, Number=item.Item, Seed=int)
int_3 = Integer(random_4)
int_4 = Integer(random_5)

rnd_vector = RandomVector(Number=number_slider, Length=Domain(1, 5))
rnd_vector_2 = RandomVector(Number=number_slider, Length=Domain(1, 5))

rnd = Random(Number=number_slider, bipolarity=True)
rnd_2 = Random(Number=number_slider, bipolarity=True)

partition = PartitionList(List=rnd_vector, Size=int_4)
partition_2 = PartitionList(List=rnd_vector_2, Size=int_3)

# ---- group: Random Testing Numbers
rnd_3 = Random(Number=number_slider, bipolarity=True)
rnd_4 = Random(Number=number_slider, bipolarity=True)

# ----
partition_3 = PartitionList(List=rnd, Size=int_4)
partition_4 = PartitionList(List=rnd_2, Size=int_3)
rnd_5 = Random(Number=number_slider, bipolarity=True)
partition_5 = PartitionList(List=rnd_3, Size=int_4)
partition_6 = PartitionList(List=rnd_4, Size=int_3)
A = Number(partition_3)
B = Number(partition_4)
vec = Vector(partition)
vec_2 = Vector(partition_2)
partition_7 = PartitionList(List=rnd_5, Size=int_4)
A_2 = Number(partition_5)
B_2 = Number(partition_6)
B_3 = Number(B)
A_3 = Number(A)
vec_3 = Vector(vec)
vec_4 = Vector(vec_2)
A_4 = Number(A)
B_4 = Number(B)
vec_5 = Vector(vec)
vec_6 = Vector(vec_2)
B_5 = Number(B_2)
A_5 = Number(A_2)
A_6 = Number(A_2)
B_6 = Number(B_2)
A_7 = Number(partition_7)
A_8 = Number(partition_7)

# ---- group: Native Comparisons
subtraction = Subtraction(A=A_3, B=B_3)
abs = Absolute(Value=subtraction)
smaller = SmallerThan(FirstNumber=abs, SecondNumber=Slider(0, range=0..0.001))  # -> SmallerThan, OrEqualTo

# ---- group: Native Vector Ops
avr = Average(Input=vec_6)
addition = Addition(A=vec_5, B=vec_6)
subtraction_2 = Subtraction(A=vec_5, B=vec_6)
bnd = Bounds2D(Coordinates=vec_6)
objfromgroup = GetObjectsInGroup()

# ---- group: Vector ops
vadd = VecAdd(A=vec_3, B=vec_4)
vsub = VecSubtract(A=vec_3, B=vec_4)
vavg = VectorAvg(A=vec_4)
vbounds = VectorBounds(A=vec_4)
objfromgroup_2 = GetObjectsInGroup()

# ---- group: Native Comparisons
smaller_2 = SmallerThan(FirstNumber=A_3, SecondNumber=B_3)  # -> SmallerThan, OrEqualTo
larger = LargerThan(FirstNumber=A_3, SecondNumber=B_3)  # -> LargerThan, OrEqualTo
equals = Equality(FirstNumber=A_3, SecondNumber=B_3)  # -> Equality, Inequality
objfromgroup_3 = GetObjectsInGroup()

# ---- group: Native Unary
avr_2 = Average(Input=A_8)
abs_2 = Absolute(Value=A_8)
bnd_2 = Bounds(Numbers=A_8)
neg = Negative(Value=A_8)
objfromgroup_4 = GetObjectsInGroup()

# ---- group: Comparisons
quickaeq = QuickAEQ(A=A_4, B=B_4)
quickeq = QuickEq(A=A_4, B=B_4)
quickgt = QuickGT(A=A_4, B=B_4)
quicklt = QuickLT(A=A_4, B=B_4)
objfromgroup_5 = GetObjectsInGroup()

# ---- group: Unary
qneg = QuickNeg(A=A_7)
qabs = QuickAbs(A=A_7)
qavg = QuickAvg(A=A_7)
qbounds = QuickBounds(A=A_7)
objfromgroup_6 = GetObjectsInGroup()

# ---- group: Arithmetic
qadd = QuickAdd(A=A_6, B=B_6)
qsub = QuickSubtract(A=A_6, B=B_6)
qmult = QuickMultiply(A=A_6, B=B_6)
qdiv = QuickDivide(A=A_6, B=B_6)
qmod = QuickMod(A=A_6, B=B_6)
objfromgroup_7 = GetObjectsInGroup()

# ---- group: Native Arithmetic
addition_2 = Addition(A=A_5, B=B_5)
subtraction_3 = Subtraction(A=A_5, B=B_5)
multiplication = Multiplication(A=A_5, B=B_5)
division = Division(A=A_5, B=B_5)
mod = Modulus(A=A_5, B=B_5)
objfromgroup_8 = GetObjectsInGroup()

# ----
number_slider_2 = Slider(0, range=0..1)
equals_2 = Equality(FirstNumber=qsub, SecondNumber=subtraction_3)  # -> Equality, Inequality
equals_3 = Equality(FirstNumber=qadd, SecondNumber=addition_2)  # -> Equality, Inequality
equals_4 = Equality(FirstNumber=qmod, SecondNumber=mod)  # -> Equality, Inequality
equals_5 = Equality(FirstNumber=qdiv, SecondNumber=division)  # -> Equality, Inequality
equals_6 = Equality(FirstNumber=qmult, SecondNumber=multiplication)  # -> Equality, Inequality
equals_7 = Equality(FirstNumber=qavg, SecondNumber=avr_2)  # -> Equality, Inequality
equals_8 = Equality(FirstNumber=qneg, SecondNumber=neg)  # -> Equality, Inequality
equals_9 = Equality(FirstNumber=qabs, SecondNumber=abs_2)  # -> Equality, Inequality
equals_10 = Equality(FirstNumber=qbounds, SecondNumber=bnd_2)  # -> Equality, Inequality
dist = Distance(PointA=vavg, PointB=avr)
dist_2 = Distance(PointA=vsub, PointB=subtraction_2)
dist_3 = Distance(PointA=vadd, PointB=addition)
dedom2 = DeconstructDomain²(Domain=bnd)  # -> UComponent, VComponent
dedom2_2 = DeconstructDomain²(Domain=vbounds)  # -> UComponent, VComponent
cset = CreateSet(List=flatten(equals_6.Equality))  # -> Set, Map
cset_2 = CreateSet(List=flatten(equals_3.Equality))  # -> Set, Map
cset_3 = CreateSet(List=flatten(equals_4.Equality))  # -> Set, Map
cset_4 = CreateSet(List=flatten(equals_2.Equality))  # -> Set, Map
cset_5 = CreateSet(List=flatten(equals_5.Equality))  # -> Set, Map
equals_11 = Equality(FirstNumber=quickgt, SecondNumber=larger.LargerThan)  # -> Equality, Inequality
equals_12 = Equality(FirstNumber=quickaeq, SecondNumber=smaller.OrEqualTo)  # -> Equality, Inequality
equals_13 = Equality(FirstNumber=quickeq, SecondNumber=equals.Equality)  # -> Equality, Inequality
equals_14 = Equality(FirstNumber=quicklt, SecondNumber=smaller_2.SmallerThan)  # -> Equality, Inequality
cset_6 = CreateSet(List=flatten(equals_9.Equality))  # -> Set, Map
cset_7 = CreateSet(List=flatten(equals_8.Equality))  # -> Set, Map
cset_8 = CreateSet(List=flatten(equals_10.Equality))  # -> Set, Map
cset_9 = CreateSet(List=flatten(equals_7.Equality))  # -> Set, Map
cset_10 = CreateSet(List=flatten(equals_12.Equality))  # -> Set, Map
cset_11 = CreateSet(List=flatten(equals_13.Equality))  # -> Set, Map
cset_12 = CreateSet(List=flatten(equals_14.Equality))  # -> Set, Map
cset_13 = CreateSet(List=flatten(equals_11.Equality))  # -> Set, Map
equals_15 = Equality(FirstNumber=dist_3, SecondNumber=number_slider_2)  # -> Equality, Inequality
equals_16 = Equality(FirstNumber=dist_2, SecondNumber=number_slider_2)  # -> Equality, Inequality
equals_17 = Equality(FirstNumber=dist, SecondNumber=number_slider_2)  # -> Equality, Inequality
equals_18 = Equality(FirstNumber=dedom2_2.UComponent, SecondNumber=dedom2.UComponent)  # -> Equality, Inequality
equals_19 = Equality(FirstNumber=dedom2_2.VComponent, SecondNumber=dedom2.VComponent)  # -> Equality, Inequality
and = GateAnd(A=cset_2.Set, B=cset_4.Set, C=cset.Set, D=cset_5.Set, E=cset_3.Set)
and_2 = GateAnd(A=cset_7.Set, B=cset_6.Set, C=cset_9.Set, D=cset_8.Set)
cset_14 = CreateSet(List=flatten(equals_15.Equality))  # -> Set, Map
cset_15 = CreateSet(List=flatten(equals_16.Equality))  # -> Set, Map
cset_16 = CreateSet(List=flatten(equals_17.Equality))  # -> Set, Map
cset_17 = CreateSet(List=flatten([equals_18.Equality, equals_19.Equality]))  # -> Set, Map
and_3 = GateAnd(A=cset_10.Set, B=cset_11.Set, C=cset_13.Set, D=cset_12.Set)
correctness = Panel(and)
correctness_2 = Panel(and_2)
proctime = ProcTime2(x=flatten(objfromgroup_8), r=and)  # -> ms; inputs x: list
# ---------- proctime: C# ----------
    ms = x.Select(o => o as GH_Component)
      .Where(e => e != null)
      .Select(e => e.ProcessorTime.TotalMilliseconds)
      .Sum();
# ---------- end proctime ----------
proctime_2 = ProcTime2(x=flatten(objfromgroup_7), r=and)  # -> ms; inputs x: list; same code as proctime
proctime_3 = ProcTime2(x=flatten(objfromgroup_4), r=and_2)  # -> ms; inputs x: list; same code as proctime
proctime_4 = ProcTime2(x=flatten(objfromgroup_6), r=and_2)  # -> ms; inputs x: list; same code as proctime
proctime_5 = ProcTime2(x=flatten(objfromgroup_5), r=and_3)  # -> ms; inputs x: list; same code as proctime
and_4 = GateAnd(A=cset_14.Set, B=cset_15.Set, C=cset_16.Set, D=cset_17.Set)
proctime_6 = ProcTime2(x=flatten(objfromgroup), r=and_4)  # -> ms; inputs x: list; same code as proctime
correctness_3 = Panel(and_3)
proctime_7 = ProcTime2(x=flatten(objfromgroup_3), r=and_3)  # -> ms; inputs x: list; same code as proctime
proctime_8 = ProcTime2(x=flatten(objfromgroup_2), r=and_4)  # -> ms; inputs x: list; same code as proctime
milliseconds_native = Panel(proctime)
milliseconds_impala = Panel(proctime_2)
milliseconds_native_2 = Panel(proctime_3)
milliseconds_impala_2 = Panel(proctime_4)
correctness_4 = Panel(and_4)
milliseconds_impala_3 = Panel(proctime_5)
milliseconds_native_3 = Panel(proctime_6)
milliseconds_native_4 = Panel(proctime_7)
milliseconds_impala_4 = Panel(proctime_8)
addition_3 = Addition(A=proctime, B=proctime_3, C=proctime_7, D=proctime_6)
addition_4 = Addition(A=proctime_2, B=proctime_4, C=proctime_5, D=proctime_8)
and_5 = GateAnd(C=and, A=and_2, E=and_3, B=and_4)
milliseconds_impala_5 = Panel(addition_4)
milliseconds_native_5 = Panel(addition_3)
correctness_5 = Panel(and_5)
rec = DataRecorder(and_5, DataLimit=-10, RecordData=True)
cset_18 = CreateSet(List=rec)  # -> Set, Map
correctness_6 = Panel(cset_18.Set)
