# Grasshopper definition benchgrptest.gh (Grasshopper 0.9.76)
# plug-ins: Heteroptera, Impala

rnd_vector = RandomVector(Number=Slider(50000, range=0..100000), Length=Domain(1, 5))
addition = Addition(A=rnd_vector, B=rnd_vector)
addition_2 = Addition(A=rnd_vector, B=rnd_vector)

merge = Merge(Data1=addition, Data2=addition_2)

gstopwatch = BenchGroup(Reset=merge)

panel = Panel(gstopwatch)
