# Grasshopper definition ccptestgen.gh (Grasshopper 0.9.76)
# plug-ins: Heteroptera, Impala

crv = Curve([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])
rnd_vector = RandomVector(Number=Slider(12, range=0..100), Length=Domain(1, 5))  # -> graft(Vectors)
rnd_vector_2 = RandomVector(Number=Slider(1000, range=0..1000), Length=Slider(20, range=0..100))
move = Move(Geometry=crv, Motion=rnd_vector)  # -> Geometry, Transform
lng = ListLength(List=rnd_vector_2)
tstat = TreeStatistics(Tree=move.Geometry)  # -> Paths, Length, Count
lng_2 = ListLength(List=tstat.Paths)
division = Division(A=lng, B=lng_2)
int = Integer(division)
crv_2 = Curve(flatten(move.Geometry))
partition = PartitionList(List=rnd_vector_2, Size=int)
parcccp = ParClosestCurveCP(Point=partition, Curves=crv_2, Threshold=1.797693135e+308)  # -> Points, Parameters, Index, Distance
lng_3 = ListLength(List=crv_2)
lng_4 = ListLength(List=parcccp.Points)
pt = Point(partition)
multiplication = Multiplication(A=lng_4, B=lng_3)  # -> flatten(Result)
vec2pt = Vector2Pt(PointA=pt, PointB=parcccp.Points, Unitize=False)  # -> Vector, Length
cset = CreateSet(List=parcccp.Index)  # -> Set, Map
ma = MassAddition(Input=multiplication)  # -> Result, PartialResults
vdis = VectorDisplay(Anchor=pt, Vector=vec2pt.Vector)
panel = Panel(ma.Result)
panel_2 = Panel(cset.Set)
sort = SortList()  # -> Keys, ValuesA
