# Grasshopper definition curveIncTest.gh (Grasshopper 0.9.76)
# plug-ins: Heteroptera, Impala

rnd_vector = RandomVector(Number=Slider(500, range=0..1000), Length=Domain(1, 5), isflat=True)
rnd_vector_2 = RandomVector(Number=Slider(5000, range=0..10000), Length=Domain(1, 5), isflat=True)
partition = PartitionList(List=rnd_vector, Size=Slider(10, range=0..10))
intcrv = Interpolate(Vertices=partition, Degree=3, Periodic=invert(False), KnotStyle=1)  # -> flatten(Curve), Length, Domain
project = Project(Geometry=intcrv.Curve, Plane=PlaneXY(0, 0, 0))  # -> Geometry, Transform
item = ListItem(List=project.Geometry, Index=0, Wrap=True)
pt = Point(rnd_vector_2)
incurve = PointInCurve(Point=pt, Curve=item)  # -> Relationship, Point
parptincrv = ParPointInCurve(Points=pt, Curve=item, Plane=PlaneXY(0, 0, 0), Strict=False)
