# Grasshopper definition inctests.gh (Grasshopper 0.9.76)
# plug-ins: Heteroptera, MeshEdit Components, Human, Weaverbird, Wombat, HDTTreeUtils, Impala

custom_mesh_settings = SettingsCustom(
    StitchSeams=True,
    SimplePlanes=False,
    Refine=True,
    MinCount=16,
    MaxCount=400,
    AspectRatio=Slider(2, range=0..10),
    MaxDistance=0,
    MaxAngle=20,
    MinEdge=Slider(0.25, range=0..1),
    MaxEdge=Slider(0.25, range=0..1))
rnd_vector = RandomVector(Number=Slider(100, range=0..100), Length=Domain(1, 5))
rnd_vector_2 = RandomVector(Number=Slider(2000, range=0..10000), Length=Domain(1, 5))
number_slider = Slider(1, range=0..1)
rectangle = Rectangle(Plane=rnd_vector, XSize=Domain(-1, 1), YSize=Domain(-2, 2), Radius=0)  # -> Rectangle, Length
drec = DeconstuctRectangle(Rectangle=rectangle.Rectangle)  # -> BasePlane, XInterval, YInterval
box = DomainBox(Base=drec.BasePlane, X=drec.XInterval, Y=drec.YInterval, Z=Slider(2, range=0..10))
smesh = SimpleMesh(Brep=box)  # -> graft(Mesh)
mesh = MeshBrep(Brep=box, Settings=custom_mesh_settings)
pt = Point(rnd_vector_2)
crv = Curve(rectangle.Rectangle)
rnd_vector_3 = RandomVector(Number=Slider(100, range=0..100), Length=Domain(1, 5))
mesh_2 = Mesh(graft(mesh))
pt_2 = Point(pt)
pt_3 = Point(pt)
parmmeshinc = ParMMeshInc(Mesh=mesh_2, Points=pt_3, Strict=False)  # -> Included, Index; disabled
pt_4 = Point(graft(pt))
pt_5 = Point(graft(pt))
merge = Merge(Data1=Slider(25.59, range=0..100), Data2=Slider(5, range=0..10))
brep = Brep(box)
number_slider_2 = Slider(1, range=0..1)
crv_2 = Curve(crv)
number_slider_3 = Slider(60, range=0..100)
crv_3 = Curve([<curve referenced from the Rhino model> x7])
jitter = Jitter(List=rnd_vector_3, Jitter=1, Seed=2)  # -> Values, Indices
yz = YZPlane(Origin=Point(0, 0, 0))
pi = Pi(Factor=number_slider)
interp = InterpolateData(Data=merge, Parameter=number_slider, Interpolation=2)
parmeshinc = ParMeshInc(Mesh=mesh_2, Points=pt_3, Strict=False)  # disabled
pt_6 = Point(pt_3)
merge_2 = Merge(Data1=Slider(0.05, range=0..0.1), Data2=Slider(0.95, range=0..1))
parptincrvs = ParPointInCurves(Points=pt_5, Curve=crv_2, Plane=PlaneXY(0, 0, 0), Strict=invert(False))  # -> Included, Index; disabled
incurves = PointInCurves(Point=pt_5, Curves=crv_2)  # -> Relationship, Index, Point; disabled
ln = Line(StartPoint=rnd_vector_3, EndPoint=jitter.Values)
parptincrv = ParPointInCurve(Points=pt_5, Curve=crv_2, Plane=PlaneXY(0, 0, 0), Strict=invert(False))  # disabled
incurve = PointInCurve(Point=pt_5, Curve=crv_2)  # -> Relationship, Point; disabled
brepsinc = PointInBreps(Brep=brep, Point=pt_4, Strict=False)  # -> Inside, Index; disabled
parbrepinc = ParBrepInc(Brep=brep, Points=pt_4, Strict=False)  # disabled
parmbrepinc = ParMBrepInc(Brep=brep, Points=pt_4, Strict=False)  # -> Included, Index; disabled
brepinc = PointInBrep(Brep=brep, Point=pt_4, Strict=False)  # disabled
minc = MeshInclusion(Mesh=mesh_2, Point=pt_3, Strict=False)  # disabled
neg = Negative(Value=interp)
cull = CullPattern(List=pt_3, CullPattern=parmeshinc)  # -> simplify(List)
interp_2 = InterpolateData(Data=[Slider(30, range=0..100), Slider(180, range=0..1000)], Parameter=number_slider, Interpolation=2)
int = Integer(brepsinc.Index)  # disabled
parcccp = ParClosestCurveCP(Point=pt_6, Curves=crv_3, Threshold=1.797693135e+308)  # -> Points, Parameters, Index, Distance
int_2 = Integer(parmbrepinc.Index)  # disabled
interp_3 = InterpolateData(Data=merge_2, Parameter=number_slider, Interpolation=2)
larger = LargerThan(FirstNumber=incurve.Relationship, SecondNumber=number_slider_2)  # -> LargerThan, OrEqualTo; disabled
int_3 = Integer(brepinc)  # disabled
Z = UnitZ(Factor=1)
int_4 = Integer(minc)  # disabled
larger_2 = LargerThan(FirstNumber=incurves.Relationship, SecondNumber=number_slider_2)  # -> LargerThan, OrEqualTo; disabled
int_5 = Integer(parbrepinc)  # disabled
pt_7 = ConstructPoint(XCoordinate=neg, YCoordinate=0, ZCoordinate=0)
int_6 = Integer(parmeshinc)  # disabled
pt_8 = ConstructPoint(XCoordinate=0, YCoordinate=0, ZCoordinate=0)
num = Number(int)  # disabled
num_2 = Number(int_2)  # disabled
vec2pt = Vector2Pt(PointA=pt_6, PointB=parcccp.Points, Unitize=False)  # -> Vector, Length
num_3 = Number(int_3)  # disabled
num_4 = Number(int_5)  # disabled
num_5 = Number(int_4)  # disabled
num_6 = Number(int_6)  # disabled
cull_2 = CullPattern(List=pt_5, CullPattern=larger.LargerThan)  # disabled
cull_3 = CullPattern(List=pt_5, CullPattern=parptincrv)  # disabled
equals = Equality(FirstNumber=num, SecondNumber=num_2)  # -> flatten(Equality), Inequality; disabled
cull_4 = CullPattern(List=pt_5, CullPattern=parptincrvs.Included)  # disabled
cull_5 = CullPattern(List=pt_5, CullPattern=larger_2.LargerThan)  # disabled
multiplication = Multiplication(A=vec2pt.Vector, B=interp_3)
mod_viewport = ModifyViewport(
    CameraLocation=pt_7,
    CameraTarget=pt_8,
    CameraProjection=Toggle(True),
    CameraLensLength=interp_2,
    CameraUp=Z,
    AnimateRestore=False,
    RestoreFrames=10)  # disabled
equals_2 = Equality(FirstNumber=num_3, SecondNumber=num_4)  # -> flatten(Equality), Inequality; disabled
equals_3 = Equality(FirstNumber=num_5, SecondNumber=num_6)  # -> flatten(Equality), Inequality; disabled
move = Move(Geometry=pt_6, Motion=multiplication)  # -> Geometry, Transform
graftbydata = GraftByData(InputData=move.Geometry, PathsToAssign=parcccp.Index)
number_slider_4 = Slider(0, range=0..1)
cset = CreateSet(List=equals.Equality)  # -> Set, Map; disabled
cset_2 = CreateSet(List=equals_2.Equality)  # -> Set, Map
convexhull = _3DConvexHull(Points=graftbydata)
cset_3 = CreateSet(List=equals_3.Equality)  # -> Set, Map; disabled
pi_2 = Pi(Factor=Slider(0.5, range=0..1))
panel = Panel(cset.Set)
wbedges = WeaverbirdsMeshEdges(MeshOrPolylines=convexhull)
range = Range(Domain=Domain(0, 1), Steps=10)
range_2 = Range(Domain=Domain(0, 1), Steps=10)
panel_2 = Panel(cset_2.Set)
panel_3 = Panel(cset_3.Set)
interp_4 = InterpolateData(Data=[number_slider_4, pi_2], Parameter=number_slider, Interpolation=2)
yz_2 = YZPlane(Origin=Point(0, 0, 0))
interp_5 = InterpolateData(Data=[number_slider_4, pi_2], Parameter=range, Interpolation=2)
interp_6 = InterpolateData(Data=merge_2, Parameter=range, Interpolation=2)  # -> graft(Value)
interp_7 = InterpolateData(Data=[number_slider_4, pi_2], Parameter=range_2, Interpolation=2)
interp_8 = InterpolateData(Data=merge_2, Parameter=range_2, Interpolation=2)  # -> graft(Value)
interp_9 = InterpolateData(
    Data=[ColourSwatch(SwatchColor=RGB(255, 0, 0)), ColourSwatch(SwatchColor=RGB(0, 0, 0))],
    Parameter=number_slider,
    Interpolation=2)
rotate = Rotate(Angle=interp_4, Plane=yz_2)  # -> Geometry, Transform
transform = Transform(Geometry=crv_3, Transform=rotate.Transform)
rotate_2 = Rotate(Geometry=transform, Angle=pi, Plane=yz)  # -> Geometry, Transform; disabled
previewlw = CustomPreviewLineweights(
    Geometry=[rotate_2.Geometry, transform],
    Shader=ColourSwatch(SwatchColor=RGB(255, 255, 255)),
    Thickness=Slider(2, range=0..10),
    Absolute=False)
transform_2 = Transform(Geometry=move.Geometry, Transform=rotate.Transform)
transform_3 = Transform(Geometry=pt_6, Transform=rotate.Transform)
preview = CustomPreview(Geometry=transform_2, Shader=ColourSwatch(SwatchColor=RGB(255, 255, 255)))
transform_4 = Transform(Geometry=wbedges, Transform=rotate.Transform)
multiplication_2 = Multiplication(A=vec2pt.Vector, B=interp_6)
multiplication_3 = Multiplication(A=vec2pt.Vector, B=interp_8)
rotate_3 = Rotate(Angle=interp_7, Plane=yz_2)  # -> Geometry, graft(Transform)
previewlw_2 = CustomPreviewLineweights(Geometry=transform_4, Shader=interp_9, Absolute=False)
rotate_4 = Rotate(Angle=interp_5, Plane=yz_2)  # -> Geometry, graft(Transform)
move_2 = Move(Geometry=pt_6, Motion=multiplication_2)  # -> Geometry, Transform
move_3 = Move(Geometry=vec2pt.Vector, Motion=multiplication_3)  # -> Geometry, Transform
number_slider_5 = Slider(0.036, range=0..0.1)
transform_5 = Transform(Geometry=move_2.Geometry, Transform=rotate_4.Transform)
transform_6 = Transform(Geometry=move_3.Geometry, Transform=rotate_3.Transform)
vec = Vector(multiplication)
pt_9 = Point(transform_3)
flip = FlipMatrix(Data=transform_5)
move_4 = Move(Geometry=pt_6, Motion=transform_6)  # -> Geometry, Transform
X = UnitX(Factor=1)
multiplication_4 = Multiplication(A=number_slider_5, B=Slider(2.9, range=0..10))
vlen = VectorLength(Vector=vec)
intcrv = Interpolate(Vertices=flip, Degree=3, Periodic=False, KnotStyle=1)  # -> Curve, Length, Domain
intcrv_2 = Interpolate(Vertices=move_4.Geometry, Degree=3, Periodic=False, KnotStyle=1)  # -> Curve, Length, Domain
bnd = Bounds(Numbers=vlen)
range_3 = Range(Domain=Domain(0, 1), Steps=Slider(3000, range=0..10000))
merge_3 = Merge(Data1=ColourSwatch(SwatchColor=RGB(0, 255, 187)), Data2=ColourSwatch(SwatchColor=RGB(85, 11, 138)))
merge_4 = Merge(
    Data1=ColourSwatch(SwatchColor=RGB(68, 207, 4)),
    Data2=ColourSwatch(SwatchColor=RGB(255, 225, 0)),
    Data3=ColourSwatch(SwatchColor=RGB(255, 0, 0)))
remap = RemapNumbers(Value=vlen, Source=bnd, Target=Domain(0, 1))  # -> Mapped, Clipped
shatter = Shatter(Curve=reparameterize(intcrv_2.Curve), Parameters=range_3)
subcrv = SubCurve(BaseCurve=intcrv.Curve, Domain=interp_3)
end = EndPoints(Curve=subcrv)  # -> Start, End
vec2pt_2 = Vector2Pt(PointA=end.Start, PointB=end.End, Unitize=False)  # -> flatten(Vector), Length
preview_2 = CustomPreview(Geometry=end.Start, Shader=ColourSwatch(SwatchColor=RGB(255, 255, 255)))
move_5 = Move(Geometry=pt_9, Motion=vec2pt_2.Vector)  # -> Geometry, Transform
multiplication_5 = Multiplication(A=vec2pt_2.Vector, B=multiplication_4)
multiplication_6 = Multiplication(A=vec2pt_2.Vector, B=number_slider_5)
xprod = CrossProduct(VectorA=X, VectorB=multiplication_6, Unitize=False)  # -> Vector, Length
interp_10 = InterpolateData(Data=merge_3, Parameter=remap.Mapped, Interpolation=3)  # -> graft(Value)
neg_2 = Negative(Value=xprod.Vector)
mp = Midpoint(Curve=shatter)
move_6 = Move(Geometry=move_5.Geometry, Motion=neg_2)  # -> graft(Geometry), Transform
parcccp_2 = ParClosestCurveCP(Point=mp, Curves=crv_3, Threshold=1.797693135e+308)  # -> Points, Parameters, Index, Distance
move_7 = Move(Geometry=move_5.Geometry, Motion=multiplication_5)  # -> graft(Geometry), Transform
move_8 = Move(Geometry=move_5.Geometry, Motion=xprod.Vector)  # -> graft(Geometry), Transform
bnd_2 = Bounds(Numbers=flatten(parcccp_2.Distance))
merge_5 = Merge(Data1=move_6.Geometry, Data2=move_7.Geometry, Data3=move_8.Geometry)
remap_2 = RemapNumbers(Value=parcccp_2.Distance, Source=bnd_2, Target=Domain(0, 1))  # -> Mapped, Clipped
ln_2 = Line(StartPoint=pt_9, EndPoint=move_5.Geometry)  # -> graft(Line)
conmesh = ConstructMesh(Vertices=merge_5, Faces={A=0, B=1, C=2, D=2})
graph = GraphMapper(
    remap_2.Mapped,
    x0=0,
    x1=1,
    y0=0,
    y1=1,
    container_name="Bezier",
    cpx=[0, 0.405027926, 0.4162011147, 1],
    cpy=[0, 0, 0.2789317369, 1])
mcol = MeshColours(Mesh=conmesh, Colours=interp_10)
previewlw_3 = CustomPreviewLineweights(Geometry=subcrv, Shader=interp_10, Thickness=Slider(2, range=0..10), Absolute=False)
larger_3 = LargerThan(FirstNumber=remap_2.Mapped, SecondNumber=Slider(0.31, range=0..1))  # -> LargerThan, OrEqualTo
cull_6 = CullPattern(List=graph, CullPattern=larger_3.LargerThan)
interp_11 = InterpolateData(
    Data=[ColourSwatch(SwatchColor=RGB(0, 0, 0)), ColourSwatch(SwatchColor=RGB(255, 255, 255))],
    Parameter=cull_6,
    Interpolation=2)
cull_7 = CullPattern(List=shatter, CullPattern=larger_3.LargerThan)
transform_7 = Transform(Geometry=cull_7, Transform=rotate.Transform)
previewlw_4 = CustomPreviewLineweights(Geometry=transform_7, Shader=interp_11, Absolute=False)
