# Grasshopper definition iptestbench.gh (Grasshopper 0.9.76)
# plug-ins: Impala

number_slider = Slider(20, range=0..100)
repeat = RepeatData(Data=Toggle(False), Length=Slider(100, range=0..100))
iptest = ImpalaTester(Recompute=repeat)  # -> Output, Runtime, DataCount; disabled
item = ListItem(List=iptest.Runtime, Index=0, Wrap=True)  # -> flatten(Item), flatten(Item1)
avr = Average(Input=item.Item)
avr_2 = Average(Input=item.Item1)
panel = Panel(avr)
panel_2 = Panel(avr_2)
