# Grasshopper definition iso2d.gh (Grasshopper 0.9.76)
# plug-ins: Heteroptera, Impala

number_slider = Slider(50, range=0..100)
number_slider_2 = Slider(40, range=0..100)
dom = ConstructDomain(DomainStart=number_slider, DomainEnd=Slider(200, range=0..1000))
rnd_vector = RandomVector(Number=number_slider_2, Length=Slider(42, range=0..1000), isflat=False)
number_slider_3 = Slider(0, range=0..6.283)
number_slider_4 = Slider(0, range=0..6.283)
rnd_vector_2 = RandomVector(Number=number_slider_2, Length=dom, isflat=True)
pdecon = Deconstruct(Point=rnd_vector)  # -> XComponent, YComponent, ZComponent
xy = XYPlane(Origin=Point(0, 0, 0))
xz = XZPlane(Origin=Point(0, 0, 0))
yz = YZPlane(Origin=Point(0, 0, 0))
rnd_vector_3 = RandomVector(Number=Slider(1, range=1..20), Length=number_slider, isflat=True)
box = CenterBox(Base=rnd_vector_2, X=pdecon.XComponent, Y=pdecon.YComponent, Z=pdecon.ZComponent)
xy_2 = XYPlane(Origin=Point(0, 0, 0))
rotate = Rotate(Angle=Slider(3.137, range=0..3.142), Plane=xz)  # -> Geometry, Transform
rotate_2 = Rotate(Angle=Slider(3.981, range=0..6.283), Plane=xy)  # -> Geometry, Transform
rotate_3 = Rotate(Angle=Slider(3.137, range=0..3.142), Plane=yz)  # -> Geometry, Transform
number_slider_5 = Slider(6.755, range=0..10)
pt = Point(rnd_vector_3)
smesh = SimpleMesh(Brep=box)
comp = Compound(Transforms=[rotate_2.Transform, rotate.Transform, rotate_3.Transform])
pi = Pi(Factor=2)
transform = Transform(Geometry=xy_2, Transform=comp)
pariso2d = ParIsoVist2D(
    Point=pt,
    Number=Slider(10000, range=0..10000),
    Radius=Slider(200, range=0..1000),
    Obstacles=smesh,
    Plane=transform,
    Interval=number_slider_5)  # -> Point, Index, Hit
smaller = SmallerThan(FirstNumber=number_slider_5, SecondNumber=pi)  # -> SmallerThan, OrEqualTo
panel = Panel("""0
-1""")
filter = StreamFilter(Gate=smaller.SmallerThan, Stream1=pt)
cull_i = CullIndex(List=pariso2d.Point, Indices=panel, Wrap=True)
merge = Merge(Data1=filter, Data2=cull_i)  # -> flatten(Result)
pline = PolyLine(Vertices=merge, Closed=invert(False))
