# Grasshopper definition iso3d.gh (Grasshopper 0.9.76)
# plug-ins: Heteroptera, Impala

number_slider = Slider(50, range=0..100)
number_slider_2 = Slider(40, range=0..100)
dom = ConstructDomain(DomainStart=number_slider, DomainEnd=Slider(200, range=0..1000))
rnd_vector = RandomVector(Number=number_slider_2, Length=Slider(42, range=0..1000))
rnd_vector_2 = RandomVector(Number=number_slider_2, Length=dom)
pdecon = Deconstruct(Point=rnd_vector)  # -> XComponent, YComponent, ZComponent
rnd_vector_3 = RandomVector(Number=Slider(1, range=1..20), Length=number_slider)
box = CenterBox(Base=rnd_vector_2, X=pdecon.XComponent, Y=pdecon.YComponent, Z=pdecon.ZComponent)
pt = Point(rnd_vector_3)
smesh = SimpleMesh(Brep=box)
pariso3d = ParIsoVist3D(Point=pt, Density=Slider(50, range=0..1000), Radius=Slider(200, range=0..1000), Obstacles=smesh)  # -> Mesh, Index, Hit
demesh = DeconstructMesh(Mesh=pariso3d.Mesh)  # -> Vertices, Faces, Colours, Normals
deface = DeconstructFace(Face=demesh.Faces)  # -> CornerA, CornerB, CornerC, CornerD
item = ListItem(List=pariso3d.Hit, Index=deface.CornerA, Wrap=True)
item_2 = ListItem(List=pariso3d.Hit, Index=deface.CornerB, Wrap=True)
item_3 = ListItem(List=pariso3d.Hit, Index=deface.CornerC, Wrap=True)
item_4 = ListItem(List=pariso3d.Hit, Index=deface.CornerD, Wrap=True)
and = GateAnd(A=item, B=item_2, C=item_3, D=item_4)
or = GateOr(A=item, B=item_2, C=item_3, D=item_4)
not = GateNot(A=or)
cull = CullPattern(List=demesh.Faces, CullPattern=not)
cull_2 = CullPattern(List=demesh.Faces, CullPattern=and)
hit_mesh = ConstructMesh(Vertices=demesh.Vertices, Faces=cull_2)
free_mesh = ConstructMesh(Vertices=demesh.Vertices, Faces=cull)
