# Grasshopper definition ivisttest.gh (Grasshopper 0.9.76)
# plug-ins: MeshEdit Components, Pufferfish, Weaverbird, Impala

pt = Point(reverse(Point(-0.09858570295, 0.06709414527, 0)))
number_slider = Slider(12000, range=0..100000)

brep = Brep(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)
popgeo = PopulateGeometry(Geometry=brep, Count=100, Seed=1)
facet = FacetDome(Points=popgeo)  # -> Pattern, Dome
brep_2 = Brep([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])
join = BrepJoin(Breps=facet.Pattern)  # -> Breps, Closed
xy = XYPlane(Origin=Point(0, 0, 0))
merge = Merge(Data1=brep_2, Data2=join.Breps)  # -> flatten(Result)
pt_2 = Point(pt)
mesh = MeshBrep(
    Brep=merge,
    Settings={GridMaxCount=0, GridMinCount=16, JaggedSeams=False, MaxEdgeLength=0, MinEdgeLength=0.0001, MinTolerance=0, Refine=True, RefineAngle=0, RelativeTolerance=0.65, SimplePlanes=True, Tolerance=0})
sec = MeshPlane(Mesh=mesh, Plane=xy)
number_slider_2 = Slider(100, range=0..100)
mjoin = MeshJoin(Meshes=mesh)
disc = Discontinuity(Curve=sec, Level=1)  # -> flatten(Points), Parameters
cir = Circle(Plane=pt_2, Radius=number_slider_2)
cullpt = CullDuplicates(Points=disc.Points, Tolerance=Slider(0.001, range=0..0.001), CullMode=1)  # -> Points, Indices, Valence
divide = DivideCurve(Curve=cir, Count=number_slider, Kinks=False)  # -> flatten(Points), Tangents, Parameters
number_slider_3 = Slider(200, range=0..1000)
merge_2 = Merge(Data1=divide.Points, Data2=cullpt.Points)  # -> flatten(Result)
alongcrv = SortAlongCurve(Points=merge_2, Curve=cir)  # -> Points, Indices
vec2pt = Vector2Pt(PointA=pt_2, PointB=alongcrv.Points, Unitize=False)  # -> Vector, Length
ln = Line(StartPoint=pt_2, EndPoint=alongcrv.Points)
meshray = MeshRay(Mesh=mjoin, Point=pt_2, Direction=vec2pt.Vector)  # -> Point, Hit
amp = Amplitude(Vector=vec2pt.Vector, Amplitude=number_slider_3)
ivray = IsoVistRay(Sample=ln, Radius=number_slider_2, Obstacles=merge)  # -> Point, Distance, Index; disabled
dist = Distance(PointA=pt_2, PointB=meshray.Point)
move = Move(Geometry=pt_2, Motion=amp)  # -> Geometry, Transform
pline = PolyLine(Vertices=ivray.Point, Closed=invert(False))  # disabled
smaller = SmallerThan(FirstNumber=dist, SecondNumber=number_slider_3)  # -> SmallerThan, OrEqualTo
and = GateAnd(A=meshray.Hit, B=smaller.SmallerThan)
p_n_c = PickNChoose(Pattern=and, Stream0=move.Geometry, Stream1=meshray.Point)
pline_2 = PolyLine(Vertices=p_n_c, Closed=False)

number_slider_4 = Slider(100, range=0..1000)
number_slider_5 = Slider(10, range=0..10000)
number_slider_6 = Slider(1000, range=0..1000)

# ---- group: Iso3d
brep_3 = Brep(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)
pt_3 = Point(pt)
number_slider_7 = Slider(50, range=0..100)
popgeo_2 = PopulateGeometry(Geometry=brep_3, Count=100, Seed=1)
number_slider_8 = Slider(200, range=0..1000)
facet_2 = FacetDome(Points=popgeo_2)  # -> Pattern, Dome
brep_4 = Brep(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)
brep_5 = Brep([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])
msphereex = MeshSphereEx(Base=pt_3, Radius=Slider(10, range=0..10), Count=number_slider_4)
join_2 = BrepJoin(Breps=facet_2.Pattern)  # -> Breps, Closed
merge_3 = Merge(Data1=brep_5, Data2=join_2.Breps, Data3=brep_4)  # -> flatten(Result)
demesh = DeconstructMesh(Mesh=msphereex)  # -> Vertices, Faces, Colours, Normals
vec2pt_2 = Vector2Pt(PointA=pt_3, PointB=demesh.Vertices, Unitize=False)  # -> Vector, Length
mjoin_2 = MeshJoin(Meshes=merge_3)
parmeshray = ParMeshRayIntersect(Mesh=mjoin_2, Point=pt_3, Direction=vec2pt_2.Vector)  # -> Point, Index, Hit
amp_2 = Amplitude(Vector=vec2pt_2.Vector, Amplitude=number_slider_8)
dist_2 = Distance(PointA=pt_3, PointB=parmeshray.Point)
deface = DeconstructFace(Face=demesh.Faces)  # -> CornerA, CornerB, CornerC, CornerD
move_2 = Move(Geometry=pt_3, Motion=amp_2)  # -> Geometry, Transform
smaller_2 = SmallerThan(FirstNumber=dist_2, SecondNumber=number_slider_8)  # -> SmallerThan, OrEqualTo
and_2 = GateAnd(A=parmeshray.Hit, B=smaller_2.SmallerThan)
int = Integer(and_2)
bool = Boolean(int)
item = ListItem(List=bool, Index=deface.CornerB, Wrap=True)
item_2 = ListItem(List=bool, Index=deface.CornerD, Wrap=True)
item_3 = ListItem(List=bool, Index=deface.CornerC, Wrap=True)
item_4 = ListItem(List=bool, Index=deface.CornerA, Wrap=True)
p_n_c_2 = PickNChoose(Pattern=and_2, Stream0=move_2.Geometry, Stream1=parmeshray.Point)
and_3 = GateAnd(A=item_4, B=item, C=item_3, D=item_2)
full_mesh = ConstructMesh(Vertices=p_n_c_2, Faces=demesh.Faces)
or = GateOr(A=item_4, B=item, C=item_3, D=item_2)
not = GateNot(A=and_3)
free_mesh = CullFaces(Mesh=full_mesh, Pattern=or)  # disabled
view_mesh = CullFaces(Mesh=full_mesh, Pattern=not)  # disabled
wbnaked = WeaverbirdsNakedBoundary(MeshClosedPolylines=free_mesh)
redpline = Reduce(Polyline=wbnaked, Tolerance=Slider(4, range=0..10))  # -> Polyline, Reduction

# ----
pariso2d = ParIsoVist2d(
    Point=pt,
    Number=number_slider,
    Radius=number_slider_3,
    Obstacles=mesh,
    Plane=PlaneXY(0, 0, 0),
    Interval=Domain(0, 6.283185307))  # -> Point, Index, Hit
pline_3 = PolyLine(Vertices=pariso2d.Point, Closed=invert(False))
panel = Panel("iv2d (smart)")
parmeshray_2 = ParMeshRayIntersect(Mesh=mjoin, Point=pt_2, Direction=vec2pt.Vector)  # -> Point, Index, Hit
demesh_2 = DeconstructMesh(Mesh=full_mesh)  # -> Vertices, Faces, Colours, Normals
pariso3d = ParIsoVist3D(Point=pt_3, Density=number_slider_4, Radius=number_slider_8, Obstacles=mjoin_2)  # -> Point, Index, Hit
brep_6 = Brep(<brep referenced from the Rhino model>)  # disabled
popgeo_3 = PopulateGeometry(Geometry=brep_6, Count=100, Seed=1)  # disabled
facet_3 = FacetDome(Points=popgeo_3)  # -> Pattern, Dome; disabled
brep_7 = Brep(<brep referenced from the Rhino model>)  # disabled
brep_8 = Brep([<brep referenced from the Rhino model> x3])  # disabled
join_3 = BrepJoin(Breps=facet_3.Pattern)  # -> Breps, Closed; disabled
merge_4 = Merge(Data1=brep_8, Data2=join_3.Breps, Data3=brep_7)  # -> flatten(Result); disabled
debrep = DeconstructBrep(Brep=merge_4)  # -> Faces, Edges, Vertices; disabled
number_slider_9 = Slider(50, range=0..100)  # disabled
number_slider_10 = Slider(1, range=0..1)  # disabled
debrep_2 = DeconstructBrep(Brep=debrep.Faces)  # -> Faces, Edges, Vertices; disabled
number_slider_11 = Slider(5, range=0..10)  # disabled
number_slider_12 = Slider(10, range=0..10)  # disabled
number_slider_13 = Slider(7, range=0..10)  # disabled
pt_4 = Point(<point referenced from the Rhino model>)  # disabled
join_4 = JoinCurves(Curves=debrep_2.Edges, Preserve=False)  # disabled
explode = Explode(Curve=join_4, Recursive=True)  # -> Segments, Vertices; disabled
disc_2 = Discontinuity(Curve=join_4, Level=1)  # -> simplify(Points), Parameters; disabled
divlength = DivideLength(Curve=explode.Segments, Length=number_slider_11)  # -> simplify(Points), Tangents, Parameters; disabled
divide_2 = DivideCurve(Curve=explode.Segments, Count=number_slider_13, Kinks=False)  # -> simplify(Points), Tangents, Parameters; disabled
msphereex_2 = MeshSphereEx(Base=pt_4, Radius=number_slider_12, Count=number_slider_9)  # disabled
sph = Sphere(Base=pt_4, Radius=number_slider_12)  # disabled
range = Range(Domain=Domain(0, 1), Steps=10)  # disabled
trim = TrimTree(Tree=divide_2.Points, Depth=1)  # disabled
srf = Surface(reparameterize(simplify(sph)))  # disabled
srf_cp = SurfaceClosestPoint(Point=trim, Surface=reparameterize(srf))  # -> Point, UVPoint, Distance; disabled
srf_cp_2 = SurfaceClosestPoint(Point=divlength.Points, Surface=reparameterize(srf))  # -> Point, UVPoint, Distance; disabled
demesh_3 = DeconstructMesh(Mesh=msphereex_2)  # -> Vertices, Faces, Colours, Normals; disabled
pt_5 = ConstructPoint(XCoordinate=range, YCoordinate=graft(range), ZCoordinate=0)  # -> flatten(Point); disabled
number_slider_14 = Slider(0, range=0..1)  # disabled
srf_cp_3 = SurfaceClosestPoint(Point=debrep.Vertices, Surface=reparameterize(srf))  # -> Point, flatten(UVPoint), Distance; disabled
trim_2 = TrimTree(Tree=srf_cp.UVPoint, Depth=1)  # disabled
srf_cp_4 = SurfaceClosestPoint(Point=demesh_3.Vertices, Surface=reparameterize(srf))  # -> Point, UVPoint, Distance; disabled
hull = ConvexHull(Points=trim_2, Plane=PlaneXY(0, 0, 0))  # -> flatten(Hull), HullZ, Indices; disabled
join_5 = JoinCurves(Curves=hull.Hull, Preserve=False)  # -> simplify(flatten(Curves)); disabled
pt_6 = Point(flatten(srf_cp_2.UVPoint))  # disabled
merge_5 = Merge(Data1=srf_cp_4.UVPoint, Data3=srf_cp_3.UVPoint)  # -> flatten(Result); disabled
pdecon = Deconstruct(Point=merge_5)  # -> XComponent, YComponent, ZComponent; disabled
number_slider_15 = Slider(1, range=0..1)  # disabled
equalst = EqualityWithinTolerance(FirstNumber=pdecon.XComponent, SecondNumber=number_slider_14, Tolerance=0.001)  # disabled
cull = CullPattern(List=pdecon.YComponent, CullPattern=equalst)  # disabled
pt_7 = ConstructPoint(XCoordinate=number_slider_15, YCoordinate=cull, ZCoordinate=0)  # disabled
merge_6 = Merge(Data1=merge_5, Data2=pt_7, Data3=pt_6, Data4=pt_5)  # -> flatten(Result); disabled
del = DelaunayMesh(Points=merge_6, Plane=PlaneXY(0, 0, 0))  # disabled
demesh_4 = DeconstructMesh(Mesh=del)  # -> Vertices, Faces, Colours, Normals; disabled
number_slider_16 = Slider(0.01, range=0..0.01)  # disabled
demesh_5 = DeconstructMesh(Mesh=del)  # -> Vertices, Faces, Colours, Normals; disabled
pt_8 = ConstructPoint(XCoordinate=0, YCoordinate=0, ZCoordinate=0)  # disabled
parcccp = ParClosestCurveCP(Point=demesh_5.Vertices, Curves=join_5, Threshold=number_slider_16)  # -> Points, Parameters, Index, Distance; disabled
vec2pt_3 = Vector2Pt(PointA=demesh_5.Vertices, PointB=parcccp.Points, Unitize=False)  # -> Vector, Length; disabled
null = NullItem(Item=parcccp.Points)  # -> NullFlags, InvalidFlags, Description; disabled
long = LongestList(ListA=pt_8, ListB=null.NullFlags, PaddingMode=2)  # -> ListA, ListB; disabled
p_n_c_3 = PickNChoose(Pattern=null.NullFlags, Stream0=vec2pt_3.Vector, Stream1=long.ListA)  # disabled
move_3 = Move(Geometry=demesh_5.Vertices, Motion=p_n_c_3)  # -> Geometry, Transform; disabled
evalsrf = EvaluateSurface(Surface=reparameterize(srf), Point=move_3.Geometry)  # -> Point, Normal, Frame; disabled
number_slider_17 = Slider(200, range=0..1000)  # disabled
ln_2 = Line(StartPoint=pt_4, EndPoint=evalsrf.Point)  # disabled
ivray_2 = IsoVistRay(Sample=ln_2, Radius=number_slider_17, Obstacles=merge_4)  # -> Point, Distance, Index; disabled
conmesh = ConstructMesh(Vertices=ivray_2.Point, Faces=demesh_5.Faces)  # disabled
weldvertices = MeshWeldVertices(Mesh=conmesh, Tolerance=0.01)  # -> RuntimeMessage, Mesh; disabled
