# Grasshopper definition ixTests.gh (Grasshopper 1.0.7)
# plug-ins: Heteroptera, MeshEdit Components, Pufferfish, Impala

number_slider = Slider(200, range=0..1000)  # disabled
number_slider_2 = Slider(2000, range=0..10000)  # disabled
number_slider_3 = Slider(200, range=0..100000)  # disabled
number_slider_4 = Slider(30, range=0..100)  # disabled
number_slider_5 = Slider(2000, range=0..100000)  # disabled
number_slider_6 = Slider(10, range=0..10)  # disabled
number_slider_7 = Slider(50, range=0..1000)  # disabled
rnd_vector = RandomVector(Number=number_slider_2, Length=number_slider, isflat=True)  # disabled
rnd_vector_2 = RandomVector(Number=Slider(11000, range=0..100000), Length=Domain(1, 5))
rnd_vector_3 = RandomVector(Number=number_slider_3, Length=Domain(1, 5))  # disabled
rnd_vector_4 = RandomVector(Number=Slider(500, range=0..100000), Length=Domain(1, 5))
rnd_vector_5 = RandomVector(Number=number_slider_5, Length=Domain(1, 5))  # disabled
partition = PartitionList(List=rnd_vector, Size=number_slider_4)  # disabled
partition_2 = PartitionList(List=rnd_vector_2, Size=Slider(2, range=0..10))
partition_3 = PartitionList(List=rnd_vector_3, Size=number_slider_7)  # disabled
partition_4 = PartitionList(List=rnd_vector_5, Size=number_slider_6)  # disabled
partition_5 = PartitionList(List=rnd_vector_4, Size=Slider(50, range=0..1000))
intcrv = Interpolate(Vertices=partition, Degree=3, Periodic=False, KnotStyle=1)  # -> flatten(Curve), Length, Domain; disabled
convexhull = _3DConvexHull(Points=partition_5)
item = ListItem(List=partition_2, Index=0, Wrap=True)  # -> Item, Item1
lng = ListLength(List=intcrv.Curve)  # disabled
division = Division(A=lng, B=2)  # disabled
intcrv_2 = Interpolate(Vertices=partition_4, Degree=3, Periodic=False, KnotStyle=1)  # -> flatten(Curve), Length, Domain; disabled
del = DelaunayMesh(Points=partition_3, Plane=PlaneXY(0, 0, 0))  # disabled
faceb = FaceBoundaries(Mesh=convexhull)
srf = Surface(faceb)
ln = Line(StartPoint=item.Item, EndPoint=item.Item1)  # -> flatten(Line)
split = SplitList(List=intcrv.Curve, Index=division)  # -> ListA, graft(ListB); disabled
mesh = Mesh(flatten(del))  # disabled
join = BrepJoin(Breps=srf)  # -> Breps, Closed
crv = Curve(intcrv_2.Curve)  # disabled
crv_2 = Curve(split.ListB)  # disabled
crv_3 = Curve(split.ListA)  # disabled
parblx = ParBrepLineIntersect(Brep=join.Breps, Line=ln)  # -> Intersection, Points, Curves
blx = BrepLine(Brep=join.Breps, Line=ln, LimitToFirst=False, UseTasks=True)  # -> Curves, Points
blx_2 = BrepLine(Brep=join.Breps, Line=ln, LimitToFirst=False, UseTasks=False)  # -> Curves, Points
mcx = MeshCurve(Mesh=mesh, Curve=crv)  # -> Points, Faces; disabled
parmcx = ParMeshCurveIntersect(Mesh=mesh, Curve=crv)  # -> Points, Faces, Intersection; disabled
parccx = ParCurveCurveIntersect(CurveA=crv_3, CurveB=crv_2)  # -> Points, ParamsA, ParamsB, flatten(Intersection); disabled
ccx = CurveCurve(CurveA=crv_3, CurveB=crv_2)  # -> Points, ParamsA, ParamsB; disabled
ccx_2 = CurveCurve(CurveA=crv_3, CurveB=crv_2, UseTasks=False)  # -> Points, ParamsA, ParamsB; disabled
stopwatch = BenchComponent(Input=blx_2.Points)
stopwatch_2 = BenchComponent(Input=blx.Points)
stopwatch_3 = BenchComponent(Input=parblx.Points)
number_slider_8 = Slider(0, range=0..1)  # disabled
cset = CreateSet(List=parccx.Intersection)  # -> Set, Map; disabled
number_slider_9 = Slider(0, range=0..1)  # disabled
dist = Distance(PointA=mcx.Points, PointB=parmcx.Points)  # disabled
num = Number(parmcx.Faces)  # disabled
num_2 = Number(mcx.Faces)  # disabled
native_sequential = Panel(stopwatch)
impala = Panel(stopwatch_3)
native_multithread = Panel(stopwatch_2)
qeq = QuickEq(A=ccx.ParamsA, B=parccx.ParamsA)  # -> flatten(R); disabled
dist_2 = Distance(PointA=ccx.Points, PointB=parccx.Points)  # disabled
qeq_2 = QuickEq(A=ccx.ParamsB, B=parccx.ParamsB)  # -> flatten(R); disabled
dseq = DSEQ(T=ccx.Points, T_2=parccx.Points)  # -> R, txt_4; disabled
panel = Panel(cset.Set)  # disabled
qeq_3 = QuickEq(A=dist, B=number_slider_8)  # -> flatten(R); disabled
qeq_4 = QuickEq(A=num_2, B=num)  # -> flatten(R); disabled
cset_2 = CreateSet(List=flatten(dist_2))  # -> Set, Map; disabled
qaeq = QuickAEQ(A=dist_2, B=number_slider_9)  # -> flatten(R); disabled
cset_3 = CreateSet(List=qeq)  # -> Set, Map; disabled
cset_4 = CreateSet(List=qeq_2)  # -> Set, Map; disabled
cset_5 = CreateSet(List=qeq_3)  # -> Set, Map; disabled
cset_6 = CreateSet(List=qeq_4)  # -> Set, Map; disabled
cset_7 = CreateSet(List=qaeq)  # -> Set, Map; disabled
and = GateAnd(A=cset_5.Set, B=cset_6.Set)  # disabled
dist_3 = Distance(PointA=blx_2.Points, PointB=parblx.Points)  # -> flatten(Distance)
panel_2 = Panel(dseq.R)  # disabled
and_2 = GateAnd(A=cset_7.Set, B=cset_3.Set, C=cset_4.Set)  # disabled
panel_3 = Panel(and)  # disabled
num_3 = Number(dist_3)
dseq_2 = DSEQ(T=blx_2.Points, T_2=parblx.Points)  # -> R, txt_4; disabled
panel_4 = Panel(and_2)  # disabled
equalst = EqualityWithinTolerance(FirstNumber=num_3, SecondNumber=Slider(0, range=0..1), Tolerance=0.001)
cset_8 = CreateSet(List=equalst)  # -> Set, Map
panel_5 = Panel(cset_8.Set)
panel_6 = Panel(dseq_2.R)

# ==== cluster DSEQ
T = ClusterInput()
T_2 = ClusterInput()
tstat = TreeStatistics(Tree=T)  # -> Paths, Length, Count
tstat_2 = TreeStatistics(Tree=T_2)  # -> Paths, Length, Count
txt = Text(tstat_2.Paths)
num = Number(tstat_2.Length)
txt_2 = Text(tstat.Paths)
num_2 = Number(tstat.Length)
equals = Equality(FirstNumber=tstat.Count, SecondNumber=tstat_2.Count)  # -> Equality, Inequality
qeq = QuickEq(A=num_2, B=num)
tmatch = MatchText(Text=txt_2, Pattern=txt, Case=True)  # -> flatten(Match)
cset = CreateSet(List=qeq)  # -> Set, Map
cset_2 = CreateSet(List=tmatch)  # -> Set, Map
symdom = SymmetricalDomain(Length=Slider(0.25, range=0..1), Base=cset.Map)
fdom = FindDomain(Domains=symdom, Number=Slider(1, range=0..1), Strict=False)  # -> Index, Neighbour
and = GateAnd(A=cset_2.Set, B=cset.Set, C=equals.Equality)
item = ListItem(List=tstat_2.Paths, Index=fdom.Index, Wrap=True)
R = ClusterOutput(and)
txt_3 = Text(item)
txt_4 = ClusterOutput(txt_3)
