# Grasshopper definition meshFlowTest.gh (Grasshopper 0.9.76)
# plug-ins: Impala

srf = Surface(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)
sph = Sphere(Base=PlaneXY(0, 0, 0), Radius=Slider(20, range=0..100))
mesh = MeshBrep(
    Brep=sph,
    Settings={GridMaxCount=0, GridMinCount=16, JaggedSeams=False, MaxEdgeLength=5, MinEdgeLength=5, MinTolerance=0, Refine=True, RefineAngle=0, RelativeTolerance=0.65, SimplePlanes=True, Tolerance=0})
neg = Negative(Value=Slider(25, range=0..100))
pi = Pi(Factor=0.5)
facen = FaceNormals(Mesh=mesh)  # -> Centers, Normals
pdecon = Deconstruct(Point=facen.Centers)  # -> XComponent, YComponent, ZComponent
division = Division(A=pdecon.ZComponent, B=20)
multiplication = Multiplication(A=pi, B=division)
number_slider = Slider(0.01, range=0..0.01)
rotate = Rotate(Geometry=facen.Centers, Angle=multiplication, Plane=PlaneXY(0, 0, 0))  # -> Geometry, Transform
pdecon_2 = Deconstruct(Point=rotate.Geometry)  # -> XComponent, YComponent, ZComponent
sqr = Square(Value=pdecon_2.ZComponent)
bnd = Bounds(Numbers=sqr)
remap = RemapNumbers(Value=sqr, Source=bnd, Target=Slider(20, range=0..100))  # -> Mapped, Clipped
multiplication_2 = Multiplication(A=division, B=remap.Mapped)
pt = ConstructPoint(XCoordinate=pdecon_2.XComponent, YCoordinate=pdecon_2.YComponent, ZCoordinate=multiplication_2)
ln = Line(StartPoint=facen.Centers, EndPoint=pt)
vec2pt = Vector2Pt(PointA=facen.Centers, PointB=pt, Unitize=False)  # -> Vector, Length
parmeshflow = ParMeshFlow(
    StartPoints=facen.Centers,
    Mesh=mesh,
    Tolerance=Slider(0.05, range=0..0.1),
    MaximumSteps=Slider(1000, range=0..1000),
    Direction=vec2pt.Vector)  # -> Curves, Lengths, Steps
