# Grasshopper definition metavoronoi.gh (Grasshopper 0.9.76)
# plug-ins: Heteroptera, Wombat, HDTTreeUtils, Impala

rnd_vector = RandomVector(Number=Slider(26, range=0..100), Length=Slider(20, range=0..100), isflat=True)
partition = PartitionList(List=rnd_vector, Size=Slider(2, range=0..10))
item = ListItem(List=partition, Index=0, Wrap=True)  # -> Item, Item1
ln = Line(StartPoint=item.Item, EndPoint=item.Item1)
mp = Midpoint(Curve=ln)
rotate = Rotate(Geometry=ln, Angle=Slider(3.456, range=0..6.283), Plane=mp)  # -> Geometry, Transform
bbox = BoundingBox(Content=flatten(ln), Plane=PlaneXY(0, 0, 0), UnionBox=True)  # -> Box, Box_2
flatten = FlattenTree(Tree=rotate.Geometry, Path="{0}")
pophalton = HaltonSequence(Box=bbox.Box, Number=Slider(10000, range=0..10000))
crv_cp = CurveClosestPoint(Point=pophalton, Curve=graft(flatten))  # -> Point, Parameter, Distance; disabled
parcccp = ParClosestCurveCP(Point=pophalton, Curves=flatten, Threshold=1.797693135e+308)  # -> Points, Parameters, Index, Distance
graftbydata = GraftByData(InputData=pophalton, PathsToAssign=parcccp.Index)
tstat = TreeStatistics(Tree=graftbydata)  # -> Paths, Length, Count
lng = ListLength(List=tstat.Paths)
multiplication = Multiplication(A=lng, B=3)
random = Random(Range=Domain(0, 1), Number=multiplication, Seed=2)
partition_2 = PartitionList(List=random, Size=Slider(3, range=0..10))
item_2 = ListItem(List=partition_2, Index=0, Wrap=True)  # -> Item, Item1, Item2
frgb = ColourRGBF(Alpha=1, Red=item_2.Item, Green=item_2.Item1, Blue=item_2.Item2)
preview = CustomPreview(Geometry=graftbydata, Shader=frgb)
