# Grasshopper definition morphtest.gh (Grasshopper 0.9.76)
# plug-ins: Impala

number_slider = Slider(4, range=0..10)
dom² = ConstructDomain²(DomainU=Domain(0, 1), DomainV=Domain(0, 1))
divide = DivideDomain²(Domain=dom², UCount=number_slider, VCount=number_slider)
dedom2 = DeconstructDomain²(Domain=divide)  # -> UComponent, VComponent
box = DomainBox(Base=PlaneXY(0, 0, 0), X=dedom2.UComponent, Y=dedom2.VComponent, Z=Slider(0.1, range=0..0.1))
srf = Surface(reparameterize(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))
boxprop = BoxProperties(Box=box)  # -> Center, Diagonal, Area, Volume, Degeneracy
sbox = SurfaceBox(Surface=srf, Domain=divide, Height=1)
sph = Sphere(Base=boxprop.Center, Radius=Slider(0.05, range=0..1))
box_2 = Box(box)
tbox = TwistedBox(sbox)
geo = Geometry(sph)
parboxmorph = ParBoxMorph(Geometry=geo, Reference=box_2, Target=tbox)
morph = BoxMorph(Geometry=geo, Reference=box_2, Target=tbox)
