# Grasshopper definition orientTest.gh (Grasshopper 0.9.76)

srf = Surface(<surface referenced from the Rhino model>)
Z = UnitZ(Factor=1)
pt = ConstructPoint(XCoordinate=0, YCoordinate=0, ZCoordinate=0)
popgeo = PopulateGeometry(Geometry=srf, Count=100, Seed=1)
neg = Negative(Value=Z)
move = Move(Geometry=pt, Motion=neg)  # -> Geometry, Transform
move_2 = Move(Geometry=pt, Motion=Z)  # -> Geometry, Transform
plfit = PlaneFit(Points=[move_2.Geometry, move.Geometry, pt])  # -> Plane, Deviation
# Moving origin across the 2 vectors
# Fit plane
# Find angle btwn vectors in plane
# create rotation around plane normal of start -> end
# NO ZERO LENGTH VECTORS
# == trasnform
# 
# Transform Geo
# Flow
# Untransform Flow
angle = Angle(VectorA=Z, VectorB=neg, Plane=plfit.Plane)  # -> Angle, Reflex
Z_2 = UnitZ(Factor=1)
neg_2 = Negative(Value=Z_2)
rotate = Rotate(Angle=angle.Reflex, Plane=plfit.Plane)  # -> Geometry, Transform
transform = Transform(Geometry=popgeo, Transform=rotate.Transform)
transform_2 = Transform(Geometry=srf, Transform=rotate.Transform)
srf_cp = SurfaceClosestPoint(Point=transform, Surface=transform_2)  # -> Point, UVPoint, Distance
evalsrf = EvaluateSurface(Surface=transform_2, Point=srf_cp.UVPoint)  # -> Point, Normal, Frame
deplane = DeconstructPlane(Plane=evalsrf.Frame)  # -> Origin, XAxis, YAxis, ZAxis
angle_2 = Angle(VectorA=neg_2, VectorB=deplane.XAxis, Plane=evalsrf.Frame)  # -> Angle, Reflex
prot = RotatePlane(Plane=evalsrf.Frame, Angle=angle_2.Reflex)
matrix = TransformMatrix(rotate.Transform, Digits=3)
deplane_2 = DeconstructPlane(Plane=prot)  # -> Origin, XAxis, YAxis, ZAxis
inverse = InverseTransform(Transform=rotate.Transform)
amp = Amplitude(Vector=deplane_2.XAxis, Amplitude=Slider(1, range=0..1))
transform_3 = Transform(Geometry=amp, Transform=inverse)
move_3 = Move(Geometry=deplane_2.Origin, Motion=amp)  # -> Geometry, Transform
vdis = VectorDisplay(Anchor=deplane_2.Origin, Vector=amp)
vdis_2 = VectorDisplay(Anchor=popgeo, Vector=transform_3)
