# Grasshopper definition parCCP_test.gh (Grasshopper 0.9.76)
# plug-ins: Heteroptera, Python Interpreter, Human, LunchBox, MetaHopper, Wombat, HDTTreeUtils, Telepathy, Impala

number_slider = Slider(15, range=0..100)
number_slider_2 = Slider(18, range=0..100)
number_slider_3 = Slider(10000, range=0..100000)
multiplication = Multiplication(A=number_slider, B=number_slider_3)
repeat = RepeatData(Data=number_slider, Length=number_slider_3)
rnd_vector = RandomVector(Number=multiplication, Length=number_slider_2)
partition = PartitionList(List=rnd_vector, Size=number_slider)
rnd_vector_2 = RandomVector(Number=number_slider_3, Length=number_slider_2)
pline = PolyLine(Vertices=partition, Closed=False)  # -> flatten(Polyline)

# ---- group: File Setup
panel = Panel("""_-Options _Appearance _Colors _Viewport _Background=255,255,255 _Enter _Enter _Enter
_Grid _ShowGrid=No _ShowGridAxes=No _ShowWorldAxes=No _ApplyTo=AllViewports _Enter""")
Y = UnitY(Factor=1)
pt = Point(Point(5, 5, 10))
pt_2 = Point(Point(5, 5, 0))
rhcom = RhinoCommand(SendCommandToggle=Toggle(True), CommandString=panel)
mod_viewport = ModifyViewport(ViewportName="Top", CameraLocation=pt, CameraTarget=pt_2, CameraUp=Y, AnimateRestore=False, RestoreFrames=10)

# ----
subset = SubList(List=pline, Domain=Slider(10000, range=0..10000), Wrap=True)  # -> List, Index
subset_2 = SubList(List=rnd_vector_2, Domain=Slider(100, range=0..100), Wrap=True)  # -> List, Index

crv_cp = CurveClosestPoint(Point=graft(subset_2.List), Curve=subset.List)  # -> Point, Parameter, Distance
lng = ListLength(List=crv_cp.Distance)
objfromgroup = GetObjectsInGroup()
series = Series(Start=0, Step=1, Count=lng)
sort = SortList(Keys=crv_cp.Distance, ValuesA=crv_cp.Point, ValuesB=crv_cp.Parameter, ValuesC=series)  # -> Keys, ValuesA, ValuesB, ValuesC
distance = ListItem(List=sort.Keys, Index=0, Wrap=True)  # -> flatten(Item)
idx = ListItem(List=sort.ValuesC, Index=0, Wrap=True)  # -> flatten(Item)
param = ListItem(List=sort.ValuesB, Index=0, Wrap=True)  # -> flatten(Item)
point = ListItem(List=sort.ValuesA, Index=0, Wrap=True)  # -> flatten(Item)

partcccp = ParClosestCurveCP(Point=subset_2.List, Curves=subset.List, Threshold=1.797693135e+308)  # -> Points, Parameters, Index, Distance
baseline_components = RemoteSender(objfromgroup)
lng_2 = ListLength(List=partcccp.Distance)

# ---- group: ccp_probsize -- MUST RECOMPUTE
tstat = TreeStatistics(Tree=subset.List)  # -> Paths, Length, Count
tstat_2 = TreeStatistics(Tree=subset_2.List)  # -> Paths, Length, Count
lng_3 = ListLength(List=distance)
multiplication_2 = Multiplication(A=tstat.Length, B=tstat_2.Length)
ma = MassAddition(Input=multiplication_2)  # -> Result, PartialResults
and = GateAnd(A=lng_2, B=Toggle(False), C=lng_3)
addition = Addition(A=and, B=ma.Result)

# ---- group: Bencher_Controls
autoscale_avg = Slider(5, range=0..100)
graph_dims = Slider(10, range=0..10)
text_tag_size = Slider(0.25, range=0..1)
reset_pipeline = BooleanToggle(False)
running_av = Slider(5, range=0..100)
view_default = BooleanToggle(True)
bakegraph = BooleanToggle(False)
write_csv = BooleanToggle(False)
saveview = BooleanToggle(False)
base_name = Panel("Crv CP")
bench_name = Panel("parCCCP_Bench_Baseline")
parallel_name = Panel("partCCCP")
swatch = ColourSwatch(SwatchColor=RGB(255, 0, 0))
swatch_2 = ColourSwatch(SwatchColor=RGB(0, 115, 255))
problem_size_rc = Integer(flatten(addition))

# ----
objbynn = GetObjectByNickname(NickName=parallel_name)
benchmark_size = RemoteSender(problem_size_rc)
benchmark_name = RemoteSender(bench_name)
benchmark_autosmooth = RemoteSender(autoscale_avg)
save_default = RemoteSender(view_default)
save_bake = RemoteSender(bakegraph)
benchmark_reset = RemoteSender(reset_pipeline)
color_impala = RemoteSender(swatch)
color_baseline = RemoteSender(swatch_2)
save_csv = RemoteSender(write_csv)
impala_component = RemoteSender(objbynn)
benchmark_smooth = RemoteSender(running_av)
save_view = RemoteSender(saveview)
graph_text = RemoteSender(text_tag_size)
graph_dim = RemoteSender(graph_dims)
bnd = Bounds(Numbers=partcccp.Index)

# ---- group: Cache BEnches
baseline_components_2 = RemoteReceiver(baseline_components)
benchmark_size_2 = RemoteReceiver(benchmark_size)
impala_component_2 = RemoteReceiver(impala_component)
benchmark_size_3 = RemoteReceiver(benchmark_size)
c_script = CSharpScript(x=baseline_components_2, y=benchmark_size_2)  # -> A; inputs y: Boolean
# ---------- c_script: C# ----------
    if (y){
      GH_Component comp = x as GH_Component;
      if (x != null){
        A = comp.ProcessorTime.TotalMilliseconds;
      }
    }
    else{
      GH_Component comp = x as GH_Component;
      if (x != null){
        A = comp.ProcessorTime.TotalMilliseconds;
      }
    }
# ---------- end c_script ----------
c_script_2 = CSharpScript(x=impala_component_2, y=benchmark_size_3)  # -> A; inputs y: Boolean
# ---------- c_script_2: C# ----------
    GH_Component comp = x as GH_Component;
    if (x != null){
      A = comp.ProcessorTime.TotalMilliseconds;
    }
# ---------- end c_script_2 ----------
ma_2 = MassAddition(Input=c_script)  # -> Result, PartialResults
benchmark_reset_2 = RemoteReceiver(benchmark_reset)
benchmark_size_4 = RemoteReceiver(benchmark_size)
int = Integer(ma_2.Result)
int_2 = Integer(c_script_2)
c_script_3 = CSharpScript(x=int, y=benchmark_reset_2)  # -> out, A; inputs y: Boolean
# ---------- c_script_3: C# ----------
    keepList3.Add(x);
    if (y){
      keepList3 = new List<object>();
    }
    A = keepList3;
# ---------- c_script_3: C# additional code ----------
  private static List<object> keepList3 = new List<object>();
# ---------- end c_script_3 ----------
c_script_4 = CSharpScript(x=int_2, y=benchmark_reset_2)  # -> out, A; inputs y: Boolean
# ---------- c_script_4: C# ----------
    keepList2.Add(x);
    if (y){
      keepList2 = new List<object>();
    }
    A = keepList2;
# ---------- c_script_4: C# additional code ----------
  private static List<object> keepList2 = new List<object>();
# ---------- end c_script_4 ----------
c_script_5 = CSharpScript(x=benchmark_size_4, y=benchmark_reset_2)  # -> A; inputs y: Boolean
# ---------- c_script_5: C# ----------
    keepList.Add(x);
    if (y){
      keepList = new List<object>();
    }
    A = keepList;
# ---------- c_script_5: C# additional code ----------
  static List<object> keepList = new List<object>();
# ---------- end c_script_5 ----------
short = ShortestList(ListA=c_script_5, ListB=c_script_4.A, ListC=c_script_3.A, TrimMode=2)  # -> ListA, ListB, ListC
sort_2 = SortList(Keys=short.ListA, ValuesA=short.ListB, ValuesB=short.ListC)  # -> Keys, ValuesA, ValuesB
sort_impala = RemoteSender(sort_2.ValuesA)
sort_base = RemoteSender(sort_2.ValuesB)
sort_ps = RemoteSender(sort_2.Keys)

# ----
sort_impala_2 = RemoteReceiver(sort_impala)
sort_base_2 = RemoteReceiver(sort_base)
merge = Merge(Data1=sort_impala_2, Data2=sort_base_2)
benchmark_autosmooth_2 = RemoteReceiver(benchmark_autosmooth)
sort_3 = SortList(Keys=merge)  # -> Keys, ValuesA
rev = ReverseList(List=sort_3.Keys)
subset_3 = SubList(List=rev, Domain=benchmark_autosmooth_2, Wrap=True)  # -> List, Index
avr = Average(Input=subset_3.List)
item = ListItem(List=avr, Index=0, Wrap=True)
benchmark_maxtime = RemoteSender(item)

# ---- group: Correctness
int_3 = Integer(idx)
equals = Equality(FirstNumber=partcccp.Distance, SecondNumber=distance)  # -> Equality, Inequality
equals_2 = Equality(FirstNumber=partcccp.Points, SecondNumber=point)  # -> Equality, Inequality
equals_3 = Equality(FirstNumber=partcccp.Parameters, SecondNumber=param)  # -> Equality, Inequality
equals_4 = Equality(FirstNumber=partcccp.Index, SecondNumber=int_3)  # -> Equality, Inequality
cset = CreateSet(List=equals_2.Equality)  # -> Set, Map
cset_2 = CreateSet(List=equals_3.Equality)  # -> Set, Map
cset_3 = CreateSet(List=equals.Equality)  # -> Set, Map
cset_4 = CreateSet(List=equals_4.Equality)  # -> Set, Map
and_2 = GateAnd(A=cset.Set, B=cset_2.Set, C=cset_4.Set, D=cset_3.Set)

# ---- group: Curve CP
parcurvecp = CurveClosestPointParallel(Point=subset_2.List, Curve=subset.List, Tolerance=1.797693135e+308)  # -> Point, Parameter, Projected; disabled
crv_cp_2 = CurveClosestPoint(Point=subset_2.List, Curve=subset.List)  # -> Point, Parameter, Distance; disabled
null = NullItem(Item=parcurvecp.Point)  # -> NullFlags, InvalidFlags, Description
null_2 = NullItem(Item=crv_cp_2.Point)  # -> NullFlags, InvalidFlags, Description
tstat_3 = TreeStatistics(Tree=crv_cp_2.Point)  # -> Paths, Length, Count; disabled
tstat_4 = TreeStatistics(Tree=parcurvecp.Point)  # -> Paths, Length, Count; disabled
flatten = FlattenTree(Tree=parcurvecp.Parameter, Path="{0}")  # disabled
flatten_2 = FlattenTree(Tree=crv_cp_2.Parameter, Path="{0}")  # disabled
dpath = DeconstructPath(Branch=tstat_4.Paths)  # disabled
equals_5 = Equality(FirstNumber=null.NullFlags, SecondNumber=null_2.NullFlags)  # -> Equality, Inequality
dpath_2 = DeconstructPath(Branch=tstat_3.Paths)  # disabled
equals_6 = Equality(FirstNumber=flatten, SecondNumber=flatten_2)  # -> Equality, Inequality; disabled
equals_7 = Equality(FirstNumber=dpath, SecondNumber=dpath_2)  # -> flatten(Equality), Inequality; disabled
equals_8 = Equality(FirstNumber=tstat_4.Length, SecondNumber=tstat_3.Length)  # -> Equality, Inequality; disabled
equals_9 = Equality(FirstNumber=tstat_4.Count, SecondNumber=tstat_3.Count)  # -> Equality, Inequality; disabled
cset_5 = CreateSet(List=equals_5.Equality)  # -> Set, Map
cset_6 = CreateSet(List=equals_6.Equality)  # -> Set, Map; disabled
cset_7 = CreateSet(List=equals_7.Equality)  # -> Set, Map; disabled
cset_8 = CreateSet(List=equals_8.Equality)  # -> Set, Map; disabled
and_3 = GateAnd(A=cset_7.Set, B=cset_8.Set, C=equals_9.Equality)  # disabled
and_4 = GateAnd(C=cset_5.Set, A=cset_6.Set, B=and_3)  # disabled
result = RemoteSender(and_4)

# ----
result_2 = RemoteReceiver(result)
panel_2 = Panel(result_2)

# ---- group: Problem Size
sort_ps_2 = RemoteReceiver(sort_ps)
rev_2 = ReverseList(List=sort_ps_2)
graph_dim_2 = RemoteReceiver(graph_dim)
item_2 = ListItem(List=rev_2, Index=0, Wrap=True)
division = Division(A=graph_dim_2, B=item_2)
multiplication_3 = Multiplication(A=sort_ps_2, B=division)
graftbydata = GraftByData(InputData=multiplication_3, PathsToAssign=sort_ps_2)
benchmark_maxps = RemoteSender(item_2)
avr_2 = Average(Input=graftbydata)  # -> flatten(ArithmeticMean)
bench_xvalue = RemoteSender(avr_2)

# ---- group: Graph Setup
X = UnitX(Factor=1)
graph_dim_3 = RemoteReceiver(graph_dim)
pt_3 = Point(Point(0, 0, 0))
Y_2 = UnitY(Factor=1)
graph_dim_4 = RemoteReceiver(graph_dim)
pt_4 = Point(Point(0, 0, 0))
Y_3 = UnitY(Factor=1)
line = LineSDL(Start=pt_3, Direction=X, Length=graph_dim_3)
number_slider_4 = Slider(10, range=0..10)
number_slider_5 = Slider(1, range=0..1)
line_2 = LineSDL(Start=pt_4, Direction=Y_2, Length=graph_dim_4)
benchmark_maxtime_2 = RemoteReceiver(benchmark_maxtime)
curvepoint = PointOnCurve(line, parameter=0.5)
neg = Negative(Value=Y_3)
divide = DivideCurve(Curve=line, Count=10, Kinks=False)  # -> Points, Tangents, Parameters
divide_2 = DivideCurve(Curve=line_2, Count=10, Kinks=False)  # -> Points, Tangents, Parameters
benchmark_maxps_2 = RemoteReceiver(benchmark_maxps)
recgrid = Rectangular(Plane=PlaneXY(0, 0, 0), SizeX=number_slider_5, SizeY=number_slider_5, ExtentX=number_slider_4, ExtentY=number_slider_4)  # -> Cells, Points
move = Move(Geometry=curvepoint, Motion=neg)  # -> Geometry, Transform
multiplication_4 = Multiplication(A=divide_2.Parameters, B=benchmark_maxtime_2)
pt_5 = Point(Point(-0.5, 0, 0))
pt_6 = Point(Point(0, -0.5, 0))
move_2 = Move(Geometry=divide_2.Points, Motion=pt_5)  # -> Geometry, Transform
move_3 = Move(Geometry=divide.Points, Motion=pt_6)  # -> Geometry, Transform
multiplication_5 = Multiplication(A=benchmark_maxps_2, B=divide.Parameters)
tag = TextTag3D(
    Location=move.Geometry,
    Text="Problem size",
    Size=Slider(0.5, range=0..1),
    Colour=ColourSwatch(SwatchColor=RGB(0, 0, 0)),
    Justification=2)
benchmark_name_2 = RemoteReceiver(benchmark_name)
formats = PythonScript(x=multiplication_4)  # -> a
# ---------- formats: Python ----------
num = int(x)

sec = 1000
min = sec * 60
hr = min * 60

if num > hr * 10:
    n = str(int(num/hr)) + "H"
elif num > min * 10:
    n = str(int(num/min)) + "M" 
elif num > sec * 10:
    n = str(int(num/sec)) + "S"
else:
    n = str(num)

a = n
# ---------- end formats ----------
crv = Curve(recgrid.Cells)
graph_text_2 = RemoteReceiver(graph_text)
swatch_3 = ColourSwatch(SwatchColor=RGB(0, 0, 0))
formatk = PythonScript(x=multiplication_5)  # -> a
# ---------- formatk: Python ----------
num = int(x)

if num > 10000000000:
    n = str(int(num/1000000000)) + "B"
elif num > 10000000:
    n = str(int(num/1000000)) + "M" 
elif num > 10000:
    n = str(int(num/1000)) + "K"
else:
    n = str(num)

a = n
# ---------- end formatk ----------
preview = CustomPreview(Geometry=crv, Shader=ColourSwatch(SwatchColor=RGB(209, 209, 209)))
concat = Concatenate(FragmentA=formats, FragmentB=" ms")
concat_2 = Concatenate(FragmentA=benchmark_name_2, FragmentC="::", FragmentB="Graph")
preview_2 = CustomPreview(Geometry=[line_2, line], Shader=ColourSwatch(SwatchColor=RGB(0, 0, 0)))
tag_2 = TextTag3D(Location=move_2.Geometry, Text=concat, Size=graph_text_2, Colour=swatch_3, Justification=9)
tag_3 = TextTag3D(Location=move_3.Geometry, Text=formatk, Size=graph_text_2, Colour=swatch_3, Justification=5)
layerattr = LayerAttr(lay=concat_2)
save_bake_2 = RemoteReceiver(save_bake)
bake = BakeGeometry(
    Bake=save_bake_2,
    Geometry=[line, line_2, divide.Points, divide_2.Points],
    Attributes=layerattr,
    DeleteOldBakes=False,
    PreserveTrees=False)

# ----
benchmark_maxtime_3 = RemoteReceiver(benchmark_maxtime)
graph_dim_5 = RemoteReceiver(graph_dim)
division_2 = Division(A=graph_dim_5, B=benchmark_maxtime_3)

# ---- group: File Setup
benchmark_name_3 = RemoteReceiver(benchmark_name)
color_impala_2 = RemoteReceiver(color_impala)
concat_3 = Concatenate(FragmentA=benchmark_name_3, FragmentC="::", FragmentB="Baseline")
color_baseline_2 = RemoteReceiver(color_baseline)
concat_4 = Concatenate(FragmentA=benchmark_name_3, FragmentC="::", FragmentB="Impala")
save_bake_3 = RemoteReceiver(save_bake)
merge_2 = Merge(Data1=concat_4, Data2=concat_3, Data3=concat_2)
merge_3 = Merge(Data1=color_impala_2, Data2=color_baseline_2, Data3=ColourSwatch(SwatchColor=RGB(0, 0, 0)))
layers = CreateModifyLayers(LayerName=merge_2, LayerColor=merge_3, Visibility=save_bake_3, DeleteLayer=False, enableFullPath=True)  # -> LayerNames, LayerFullPath
item_3 = ListItem(List=layers.LayerFullPath, Index=0, Wrap=True)

# ----
sort_impala_3 = RemoteReceiver(sort_impala)
multiplication_6 = Multiplication(A=sort_impala_3, B=division_2)
sort_ps_3 = RemoteReceiver(sort_ps)
graftbydata_2 = GraftByData(InputData=multiplication_6, PathsToAssign=sort_ps_3)
benchmark_smooth_2 = RemoteReceiver(benchmark_smooth)
avr_3 = Average(Input=graftbydata_2)  # -> flatten(ArithmeticMean)
bench_xvalue_2 = RemoteReceiver(bench_xvalue)
python = PythonScript(x=avr_3, y=benchmark_smooth_2)  # -> a; inputs x: list
# ---------- python: Python ----------
result = []
rng = int(y)

for i in range(len(x)):
    sum = 0
    num = 0
    for j in range(-rng,rng+1):
        if (i+j) >= 0 and (i+j) < len(x):
            sum += x[i + j]
            num += 1.0
    result.append(sum/num)
    
a = result
# ---------- end python ----------
pt_7 = ConstructPoint(XCoordinate=bench_xvalue_2, YCoordinate=python, ZCoordinate=0)
pline_2 = PolyLine(Vertices=pt_7, Closed=False)
item_4 = ListItem(List=reverse(pt_7), Index=0, Wrap=True)
merge_4 = Merge(Data1=pt_7, Data2=pline_2)
color_impala_3 = RemoteReceiver(color_impala)
layerattr_2 = LayerAttr(lay=item_3)
save_bake_4 = RemoteReceiver(save_bake)
preview_3 = CustomPreview(Geometry=pline_2, Shader=color_impala_3)
tag_4 = TextTag3D(Location=item_4, Text="  Impala", Size=Slider(0.25, range=0..1), Colour=color_impala_3, Justification=7)
preview_4 = CustomPreview(Geometry=pt_7, Shader=color_impala_3)
bake_2 = BakeGeometry(Bake=save_bake_4, Geometry=merge_4, Attributes=layerattr_2, DeleteOldBakes=False, PreserveTrees=False)

# ---- group: Baseline
sort_base_3 = RemoteReceiver(sort_base)
sort_ps_4 = RemoteReceiver(sort_ps)
multiplication_7 = Multiplication(A=sort_base_3, B=division_2)
graftbydata_3 = GraftByData(InputData=multiplication_7, PathsToAssign=sort_ps_4)
benchmark_smooth_3 = RemoteReceiver(benchmark_smooth)
avr_4 = Average(Input=graftbydata_3)  # -> flatten(ArithmeticMean)
bench_xvalue_3 = RemoteReceiver(bench_xvalue)
ravg = RunningAverage(L=avr_4, I=benchmark_smooth_3)  # -> R; inputs L: list
# ---------- ravg: Python ----------
result = []
rng = int(I)

for i in range(len(L)):
    sum = 0
    num = 0
    for j in range(-rng,rng+1):
        if (i+j) >= 0 and (i+j) < len(L):
            sum += L[i + j]
            num += 1.0
    result.append(sum/num)
    
R = result
# ---------- end ravg ----------
pt_8 = ConstructPoint(XCoordinate=bench_xvalue_3, YCoordinate=ravg, ZCoordinate=0)
save_default_2 = RemoteReceiver(save_default)
pline_3 = PolyLine(Vertices=pt_8, Closed=False)
filter = StreamFilter(Gate=save_default_2, Stream1=pline_3)
merge_5 = Merge(Data1=pt_8, Data2=pline_3)
color_baseline_3 = RemoteReceiver(color_baseline)
filter_2 = StreamFilter(Gate=save_default_2, Stream1=pt_8)
layerattr_3 = LayerAttr(lay=concat_3)
save_bake_5 = RemoteReceiver(save_bake)
item_5 = ListItem(List=reverse(pt_8), Index=0, Wrap=True)
bake_3 = BakeGeometry(Bake=save_bake_5, Geometry=merge_5, Attributes=layerattr_3, DeleteOldBakes=False, PreserveTrees=False)
tag_5 = TextTag3D(Location=item_5, Text="  Baseline", Size=Slider(0.25, range=0..1), Colour=color_baseline_3, Justification=7)
preview_5 = CustomPreview(Geometry=filter, Shader=color_baseline_3)
preview_6 = CustomPreview(Geometry=filter_2, Shader=color_baseline_3)

# ---- group: Save
benchmark_maxtime_4 = RemoteReceiver(benchmark_maxtime)
benchmark_maxps_3 = RemoteReceiver(benchmark_maxps)
bench_xvalue_4 = RemoteReceiver(bench_xvalue)
bench_xvalue_5 = RemoteReceiver(bench_xvalue)
multiplication_8 = Multiplication(A=ravg, B=benchmark_maxtime_4)
multiplication_9 = Multiplication(A=bench_xvalue_5, B=benchmark_maxps_3)
multiplication_10 = Multiplication(A=bench_xvalue_4, B=benchmark_maxtime_4)
int_4 = Integer(multiplication_10)
int_5 = Integer(multiplication_8)
int_6 = Integer(multiplication_9)
entwine = Entwine(Branch00=int_6, Branch01=int_5, Branch02=int_4, FlattenInputs=True)
benchmark_name_4 = RemoteReceiver(benchmark_name)
panel_3 = Panel("""Problem Size
Default (ms)
Impala (ms)""")
concat_5 = Concatenate(FragmentA="bench/", FragmentB=benchmark_name_4, FragmentC=".jpg")
concat_6 = Concatenate(FragmentA="bench/", FragmentB=benchmark_name_4, FragmentC=".csv")
csv = CreateCSV(DataGridHeaders=panel_3, ValueTree=entwine, Delimiter=",")
relpath = RelativePath(Path=concat_6)
relpath_2 = RelativePath(Path=concat_5)
save_csv_2 = RemoteReceiver(save_csv)
save_view_2 = RemoteReceiver(save_view)
writetxt = WriteToTextFile(Run=save_csv_2, TextToWrite=csv, FilePath=relpath, Append=False, NewOnly=False)
saveview_2 = SaveViewportToFile(Run=save_view_2, ViewportName="Top", Render=False, FilePath=relpath_2, ScaleFactor=Slider(1.5, range=0..10))
panel_4 = Panel(writetxt)
panel_5 = Panel(saveview_2)

# ==== cluster LayerAttr
lay = ClusterInput()
createatts = CreateAttributes(LayerName=lay, enableFullPath=True)
att = ClusterOutput(createatts)
