# Grasshopper definition parDivTest2.gh (Grasshopper 0.9.76)
# plug-ins: Wombat, Impala

number_slider = Slider(1, range=0..100)
domcen = CenteredDomain(DomainSize=Slider(10, range=0..100))
number_slider_2 = Slider(40, range=0..100)
number_slider_3 = Slider(400, range=0..10000)
random = Random(Range=domcen, Number=Slider(10000, range=0..10000), Seed=Slider(2, range=0..10))
dom = ConstructDomain(DomainStart=Slider(20, range=0..100), DomainEnd=Slider(1000, range=0..1000))
partition = PartitionList(List=random, Size=Slider(3, range=0..10))
item = ListItem(List=partition, Index=0, Wrap=True)  # -> Item, Item1, Item2
random_2 = Random(Range=dom, Number=number_slider_3, Seed=2)
pt = ConstructPoint(XCoordinate=item.Item, YCoordinate=item.Item1, ZCoordinate=item.Item2)  # -> flatten(Point)
series = Series(Start=0, Step=1, Count=number_slider_3)
series_2 = Series(Start=0, Step=1, Count=Slider(1000, range=0..1000))
partition_2 = PartitionList(List=pt, Size=Slider(10, range=0..100))
series_3 = Series(Start=0, Step=1, Count=10)
intcrv = Interpolate(Vertices=partition_2, Degree=3, Periodic=False, KnotStyle=1)  # -> flatten(Curve), Length, Domain
item_2 = ListItem(List=Slider(500, range=0..1000), Index=series, Wrap=True)
jitter = Jitter(List=series_3, Jitter=1, Seed=Slider(3834, range=0..10000))  # -> Values, Indices
jitter_2 = Jitter(List=series_3, Jitter=1, Seed=Slider(1601, range=0..10000))  # -> Values, Indices
item_3 = ListItem(List=intcrv.Curve, Index=series_2, Wrap=True)
partition_3 = PartitionList(List=item_3, Size=jitter.Values)
partition_4 = PartitionList(List=item_2, Size=jitter_2.Values)
pardivlen = ParDivideLength(Curve=partition_3, Length=partition_4)  # -> Points, Tangents, Parameters
divlength = DivideLength(Curve=partition_3, Length=partition_4)  # -> Points, Tangents, Parameters
tstat = TreeStatistics(Tree=divlength.Points)  # -> Paths, Length, Count
tstat_2 = TreeStatistics(Tree=pardivlen.Parameters)  # -> Paths, Length, Count
equals = Equality(FirstNumber=divlength.Parameters, SecondNumber=pardivlen.Parameters)  # -> flatten(Equality), Inequality
dpath = DeconstructPath(Branch=tstat.Paths)  # -> graft(Indices)
dpath_2 = DeconstructPath(Branch=tstat_2.Paths)  # -> graft(Indices)
equals_2 = Equality(FirstNumber=tstat.Length, SecondNumber=tstat_2.Length)  # -> Equality, Inequality
equals_3 = Equality(FirstNumber=divlength.Points, SecondNumber=pardivlen.Points)  # -> flatten(Equality), Inequality; disabled
mindex = MemberIndex(Set=equals_2.Equality, Member=Toggle(False))  # -> Index, Count
equals_4 = Equality(FirstNumber=dpath, SecondNumber=dpath_2)  # -> flatten(Equality), Inequality
cset = CreateSet(List=equals.Equality)  # -> Set, Map
cset_2 = CreateSet(List=equals_3.Equality)  # -> Set, Map
panel = Panel(cset.Set)
cset_3 = CreateSet(List=equals_2.Equality)  # -> Set, Map
cset_4 = CreateSet(List=equals_4.Equality)  # -> Set, Map
equals_5 = Equality(FirstNumber=tstat.Count, SecondNumber=tstat_2.Count)  # -> Equality, Inequality
and = GateAnd(A=cset_3.Set, B=cset_4.Set, C=equals_5.Equality)
rec = DataRecorder(and, DataLimit=-10, RecordData=True)
cset_5 = CreateSet(List=flatten(rec))  # -> Set, Map
