# Grasshopper definition parPCPTest.gh (Grasshopper 0.9.76)
# plug-ins: Heteroptera, Telepathy, Impala

rnd_vector = RandomVector(Number=Slider(4000, range=0..10000), Length=Slider(20, range=0..100))
rnd_vector_2 = RandomVector(Number=Slider(5000, range=0..10000), Length=Domain(1, 5))
number_slider = Slider(9, range=0..10)
number_slider_2 = Slider(50, range=0..100)
number_slider_3 = Slider(1, range=0..1)
partition = PartitionList(List=rnd_vector, Size=Slider(10, range=0..10))
partition_2 = PartitionList(List=rnd_vector_2, Size=Slider(1000, range=0..1000))
pt = Point(partition)
pt_2 = Point(partition_2)
cps = ClosestPoints(Point=pt, Cloud=pt_2, Count=number_slider_2)  # -> ClosestPoint, CPIndex, Distance
parpointcp = ParPointCP(Points=pt, Cloud=pt_2, Number=number_slider_2)  # -> Points, Indices
equals = Equality(FirstNumber=cps.CPIndex, SecondNumber=parpointcp.Indices)  # -> flatten(Equality), Inequality
equals_2 = Equality(FirstNumber=cps.ClosestPoint, SecondNumber=parpointcp.Points)  # -> flatten(Equality), Inequality; disabled
cset = CreateSet(List=equals.Equality)  # -> Set, Map
cset_2 = CreateSet(List=equals_2.Equality)  # -> Set, Map
correct = RemoteSender(cset.Set)
correct_2 = RemoteReceiver(correct)
panel = Panel(correct_2)
