# Grasshopper definition pardivtest.gh (Grasshopper 0.9.76)
# plug-ins: Parallel_GH

number_slider = Slider(100, range=0..1000)
number_slider_2 = Slider(23552, range=0..100000)
number_slider_3 = Slider(32562, range=0..100000)
number_slider_4 = Slider(4600, range=0..10000)
repeat = RepeatData(Data=Slider(100, range=0..100), Length=number_slider)  # -> graft(Data)
random = Random(Range=number_slider_3, Number=number_slider, Seed=2)  # -> graft(Random)
random_2 = Random(Range=number_slider_3, Number=number_slider, Seed=number_slider_2)  # -> graft(Random)
range = Range(Domain=Slider(100, range=0..100), Steps=repeat)
number_slider_5 = Slider(10, range=0..10)
random_3 = Random(Range=Domain(0, 1), Number=number_slider_4, Seed=number_slider_3)
random_4 = Random(Range=Domain(0, 1), Number=number_slider_4, Seed=number_slider_2)
srf = Surface(reparameterize(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))
lng = ListLength(List=range)
lng_2 = ListLength(List=range)
pt = ConstructPoint(XCoordinate=random_3, YCoordinate=random_4, ZCoordinate=0)
random_5 = Random(Range=number_slider_5, Number=lng, Seed=random)
random_6 = Random(Range=number_slider_5, Number=lng_2, Seed=random_2)
pt_2 = ConstructPoint(XCoordinate=range, YCoordinate=random_5, ZCoordinate=random_6)
lng_3 = ListLength(List=pt_2)
evalsrf = EvaluateSurface(Surface=srf, Point=pt)  # -> Point, Normal, Frame
knots = KnotVector(Count=lng_3, Degree=3, Periodic=False)
nurbcrv = NurbsCurve(Points=pt_2, Knots=knots)  # -> simplify(flatten(Curve)), Length, Domain
number_slider_6 = Slider(5, range=0..10)
crv_cp = CurveClosestPoint(Point=graft(evalsrf.Point), Curve=nurbcrv.Curve)  # -> Point, Parameter, Distance; disabled
parcccp = ClosestCurveClosestPoint(Curves=nurbcrv.Curve, Points=evalsrf.Point, Threshold=0)  # -> Points, Parameters, Distance, Index; disabled
toggle = BooleanToggle(False)
partition = PartitionList(List=nurbcrv.Curve, Size=Slider(5, range=0..10))  # -> simplify(flatten(Chunks))
sort = SortList(Keys=crv_cp.Distance, ValuesA=crv_cp.Point, ValuesB=crv_cp.Parameter)  # -> Keys, ValuesA, ValuesB
lng_4 = ListLength(List=partition)
item = ListItem(List=sort.ValuesA, Index=0, Wrap=True)  # -> flatten(Item)
repeat_2 = RepeatData(Data=number_slider_6, Length=lng_4)
repeat_3 = RepeatData(Data=number_slider_6, Length=number_slider_6)  # -> simplify(Data)
equals = Equality(FirstNumber=item, SecondNumber=parcccp.Points)  # -> Equality, Inequality
divlength = DivideLength(Curve=partition, Length=number_slider_6)  # -> Points, Tangents, Parameters
pardivlen = ParDivideLength(Curve=partition, Length=repeat_3)  # -> Points, Tangents, Parameters, Lengths
cset = CreateSet(List=equals.Equality)  # -> Set, Map
equals_2 = Equality(FirstNumber=divlength.Parameters, SecondNumber=pardivlen.Parameters)  # -> flatten(Equality), Inequality
panel = Panel(cset.Set)
cset_2 = CreateSet(List=equals_2.Equality)  # -> Set, Map
panel_2 = Panel(cset_2.Set)
