# Grasshopper definition pcGenTest.gh (Grasshopper 0.9.76)
# plug-ins: Heteroptera, Impala

number_slider = Slider(102, range=0..1000)
rnd_vector = RandomVector(Number=Slider(1000, range=0..1000), Length=Domain(1, 5))
partition = PartitionList(List=rnd_vector, Size=Slider(10, range=0..10))
rnd_vector_2 = RandomVector(Number=Slider(5000, range=0..10000), Length=Domain(1, 5))
partition_2 = PartitionList(List=rnd_vector_2, Size=Slider(50, range=0..100))
pline = PolyLine(Vertices=partition, Closed=False)
pt = Point(rnd_vector_2)
crv = Curve(pline)
parcurvecpgeneric = PCCPGen(Point=pt, Curve=crv, Tolerance=1.797693135e+308)  # -> Point, Parameter, Projected
crv_cp = CurveClosestPoint(Point=pt, Curve=crv)  # -> Point, Parameter, Distance; disabled
parcurvecp = CurveClosestPoint(Point=pt, Curve=crv, Tolerance=1.797693135e+308)  # -> Point, Parameter, Projected
