# Grasshopper definition pdivgentest.gh (Grasshopper 0.9.76)
# plug-ins: Heteroptera, Impala

rnd_vector = RandomVector(Number=Slider(1000, range=0..1000), Length=Slider(120, range=0..1000))
rnd = Random(Number=10)
partition = PartitionList(List=rnd_vector, Size=Slider(20, range=0..100))
multiplication = Multiplication(A=rnd, B=Slider(20, range=0..100))  # -> graft(Result)
intcrv = Interpolate(Vertices=partition, Degree=3, Periodic=False, KnotStyle=1)  # -> flatten(Curve), Length, Domain
crv = Curve(intcrv.Curve)
num = Number(multiplication)
pardivleng = ParDivLenGeneric(Curve=crv, Length=num)  # -> Points, Tangents, Parameters
divlength = DivideLength(Curve=crv, Length=num)  # -> Points, Tangents, Parameters

# ---- group: Test Actual Equality
pt = Point(divlength.Tangents)
pt_2 = Point(pardivleng.Tangents)
dist = Distance(PointA=pt, PointB=pt_2)
dist_2 = Distance(PointA=divlength.Points, PointB=pardivleng.Points)
qaeq = QuickAEQ(A=dist_2, B=Slider(0, range=0..1))  # -> flatten(R)
qaeq_2 = QuickAEQ(A=divlength.Parameters, B=pardivleng.Parameters)  # -> flatten(R)
qaeq_3 = QuickAEQ(A=dist, B=Slider(0, range=0..1))  # -> flatten(R)
cset = CreateSet(List=qaeq)  # -> Set, Map
cset_2 = CreateSet(List=qaeq_3)  # -> Set, Map
cset_3 = CreateSet(List=qaeq_2)  # -> Set, Map
and = GateAnd(A=cset.Set, B=cset_2.Set, C=cset_3.Set)

# ---- group: Test Data Structure Equality
tstat = TreeStatistics(Tree=divlength.Points)  # -> Paths, Length, Count
tstat_2 = TreeStatistics(Tree=pardivleng.Points)  # -> Paths, Length, Count
txt = Text(tstat.Paths)
txt_2 = Text(tstat_2.Paths)
tmatch = MatchText(Text=graft(txt), Pattern=graft(txt_2), Case=True)  # -> flatten(Match)
equals = Equality(FirstNumber=tstat.Count, SecondNumber=tstat_2.Count)  # -> Equality, Inequality
and_2 = GateAnd(A=tstat.Length, B=tstat_2.Length)  # -> flatten(Result)
cset_4 = CreateSet(List=tmatch)  # -> Set, Map
cset_5 = CreateSet(List=and_2)  # -> Set, Map
and_3 = GateAnd(A=cset_4.Set, B=cset_5.Set, C=equals.Equality)

# ----
and_4 = GateAnd(A=and, B=and_3)
panel = Panel(and_4)
