# Grasshopper definition remduplntest.gh (Grasshopper 0.9.76)
# plug-ins: Heteroptera, Impala

number_slider = Slider(2400, range=0..10000)
number_slider_2 = Slider(75000, range=0..100000)
rnd_vector = RandomVector(Number=Slider(4, range=0..10), Length=Domain(1, 5))
neg = Negative(Value=Slider(5, range=0..10))
rnd_vector_2 = RandomVector(Number=Slider(300000, range=0..1000000), Length=Domain(1, 5))
item = ListItem(List=rnd_vector, Index=0, Wrap=True)  # -> Item, Item1, Item2, Item3
vec = VectorXYZ(XComponent=neg, YComponent=0, ZComponent=0)  # -> Vector, Length
ln = Line(StartPoint=item.Item2, EndPoint=item.Item3)
ln_2 = Line(StartPoint=item.Item, EndPoint=item.Item1)
move = Move(Geometry=rnd_vector_2, Motion=vec.Vector)  # -> Geometry, Transform; disabled
repeat = RepeatData(Data=[ln_2, ln], Length=Slider(4000, range=0..10000))
lng = ListLength(List=rnd_vector_2)
pt = Point(rnd_vector_2)
parremduplns = ParRemDupLns(Lines=repeat, Tolerance=0.01, Granularity=Slider(250, range=0..10000))
division = Division(A=lng, B=2)
split = SplitList(List=pt, Index=division)  # -> ListA, ListB
multiplication = Multiplication(A=division, B=Slider(0, range=0..1))
ln_3 = Line(StartPoint=split.ListA, EndPoint=split.ListB)
reduce = RandomReduce(List=ln_3, Reduction=multiplication, Seed=1)
end = EndPoints(Curve=reduce)  # -> Start, End
lng_2 = ListLength(List=reduce)
random = Random(Range=Domain(0, 1), Number=lng_2, Seed=2)
ln_4 = Line(StartPoint=end.End, EndPoint=end.Start)
p_n_c = PickNChoose(Pattern=random, Stream0=reduce, Stream1=ln_4)
merge = Merge(Data1=flatten(ln_3), Data2=flatten(p_n_c))
lng_3 = ListLength(List=ln_3)
parremduplns_2 = ParRemDupLns(Lines=merge, Tolerance=0.01, Granularity=Slider(250, range=0..1000))
lng_4 = ListLength(List=parremduplns_2)
seqremduplns = SeqRemDupLns(Lines=merge, Tolerance=0.01)  # disabled
equals = Equality(FirstNumber=lng_4, SecondNumber=lng_3)  # -> Equality, Inequality
lng_5 = ListLength(List=seqremduplns)
lng_6 = ListLength(List=parremduplns_2)
len = Length(Curve=parremduplns_2)  # disabled
len_2 = Length(Curve=seqremduplns)
panel = Panel(equals.Equality)
cset = CreateSet(List=len_2)  # -> Set, Map
cset_2 = CreateSet(List=len)  # -> Set, Map
equals_2 = Equality(FirstNumber=lng_5, SecondNumber=lng_6)  # -> Equality, Inequality
sort = SortList(Keys=cset.Set)  # -> Keys, ValuesA
sort_2 = SortList(Keys=cset_2.Set)  # -> Keys, ValuesA
equals_3 = Equality(FirstNumber=sort.Keys, SecondNumber=sort_2.Keys)  # -> Equality, Inequality
ma = MassAddition(Input=equals_3.Inequality)  # -> Result, PartialResults
equals_4 = Equality(FirstNumber=ma.Result, SecondNumber=0)  # -> Equality, Inequality
and = GateAnd(A=equals_2.Equality, B=equals_4.Equality)
