# Grasshopper definition stresstestint.gh (Grasshopper 0.9.76)
# plug-ins: Heteroptera, Impala

number_slider = Slider(100000, range=0..100000)
number_slider_2 = Slider(50, range=0..100)
pow = Power(A=Slider(10, range=0..10), B=Slider(6, range=0..10))
rnd = Random(Number=pow, bipolarity=True)
rnd_2 = Random(Number=pow, bipolarity=True)
rnd_vector = RandomVector(Number=pow, Length=number_slider_2)
rnd_vector_2 = RandomVector(Number=pow, Length=number_slider_2)
qadd = QuickAdd(A=rnd, B=rnd_2)
addition = Addition(A=rnd, B=rnd_2)
vadd = VecAdd(A=rnd_vector_2, B=rnd_vector)
addition_2 = Addition(A=rnd_vector_2, B=rnd_vector)
qmult = QuickMultiply()
multiplication = Multiplication()
qsub = QuickSubtract()
division = Division()
qdiv = QuickDivide()
