# Grasshopper definition zipcomptest.gh (Grasshopper 0.9.76)
# plug-ins: Heteroptera, MetaHopper, Wombat, Impala

number_slider = Slider(100, range=0..100000)
number_slider_2 = Slider(10000, range=0..10000)
number_slider_3 = Slider(1000, range=0..1000)
button = Button()
addition = Addition(A=Slider(100, range=0..100), B=Slider(0.5, range=0..0.5))
objbynn = GetObjectByNickname(NickName="parCurveCP")
objbynn_2 = GetObjectByNickname(NickName="Crv CP")
objbynn_3 = GetObjectByNickname(NickName="parCurveCPAuto")
rnd_vector = RandomVector(Number=number_slider, Length=addition)
rnd_vector_2 = RandomVector(Number=number_slider, Length=addition)
partition = PartitionList(List=rnd_vector, Size=Slider(10, range=0..10))
intcrv = Interpolate(Vertices=partition, Degree=3, Periodic=False, KnotStyle=1)  # -> flatten(Curve), Length, Domain
null = NullObject()
pt = Point(rnd_vector_2)
crv = Curve(intcrv.Curve)
parcurvecpauto = CurveClosestPointA(Point=pt, Curve=crv, Tolerance=1.797693135e+308)  # -> Point, Parameter, Projected
crv_cp = CurveClosestPoint(Point=pt, Curve=crv)  # -> Point, Parameter, Distance
parcurvecp = CurveClosestPoint(Point=pt, Curve=crv, Tolerance=1.797693135e+308)  # -> Point, Parameter, Projected
tstat = TreeStatistics(Tree=parcurvecpauto.Point)  # -> Paths, Length, Count
c_script = CSharpScript(x=objbynn_3, y=button, z=tstat.Count)  # -> out, A; inputs y: Boolean
# ---------- c_script: C# ----------
    if (!y){
      iterations++;
      ms += (x as GH_Component).ProcessorTime.TotalMilliseconds;
      A = ms / (double) iterations;
    }
    else{
      iterations = 0;
      ms = 0;
    }
# ---------- c_script: C# additional code ----------
  private int iterations = 0;
  private double ms = 0;
# ---------- end c_script ----------
# Results:
# parCurveCP (Zip3x3): 147ms/50k comp => 340k comp/s
# parManual (looping): 135ms/50k comp => 370k comp/s
#     Crv CP (baseline): 464ms/50k comp => 107.5k comp/s
panel = Panel(c_script.A)
tstat_2 = TreeStatistics(Tree=crv_cp.Point)  # -> Paths, Length, Count
c_script_2 = CSharpScript(x=objbynn_2, y=button, z=tstat_2.Count)  # -> out, A; inputs y: Boolean; same code as c_script
panel_2 = Panel(c_script_2.A)
tstat_3 = TreeStatistics(Tree=parcurvecp.Point)  # -> Paths, Length, Count
c_script_3 = CSharpScript(x=objbynn, y=button, z=tstat_3.Count)  # -> out, A; inputs y: Boolean; same code as c_script
panel_3 = Panel(c_script_3.A)
